# Grasshopper definition test_evol_0.02.gh (Grasshopper 1.0.8)
# plug-ins: Geospiza, Pufferfish, Anemone

python_3_script = Python3Script()  # -> out, a
# ---------- python_3_script: Python ----------
# Grasshopper Python script to generate a pulse when a loop restarts

if not 'last_count' in globals():
    last_count = -1
    pulse = False

# Read the input (ensure you connect an integer counter from Anemone)
loop_count = int(x)  # Connect Anemone loop count to 'x' input

# Check if the loop has restarted (increment detected)
if loop_count > last_count:
    pulse = True  # Set pulse to True momentarily
    last_count = loop_count  # Update last count

else:
    pulse = False  # Ensure it's False otherwise

# Output the pulse
a = pulse
# ---------- end python_3_script ----------
python_3_script_2 = Python3Script()  # -> out, a; same code as python_3_script
construct_point = ConstructPoint(XCoordinate=0, YCoordinate=0, ZCoordinate=0)
construct_point_2 = ConstructPoint(XCoordinate=Slider(120, range=0..1000), YCoordinate=0, ZCoordinate=0)
line = Line(StartPoint=construct_point, EndPoint=construct_point_2)
curve = Curve(line)
loop_start = LoopStart(Repeat=Slider(0, range=0..10), Trigger=Toggle(True), Data=curve)  # -> port, Counter, Data
curve_2 = Curve(loop_start.Data)
number_slider = Slider(0.4914, range=0..1)
reparameterize_curve = ReparameterizeCurve(Curve=curve_2)  # -> Reparameterized, Original
shatter = Shatter(Curve=reparameterize_curve.Reparameterized, Parameters=number_slider)  # -> graft(Segments)
gene_collector = GeneCollector(GeneParams=number_slider)
explode_tree = ExplodeTree(Data=simplify(shatter))  # -> Branch0, Branch1
stochastic_universal_sampling = StochasticUniversalSampling()
fixed_value_mutation = FixedValueMutation(MutationRate=0.01, MutationValue=Slider(0.01, range=0..1))
inbreeding_pairing = InbreedingPairing(InBreedingFactor=Slider(0.05, range=0..0.8), DistanceFunction=1)
text = Text(gene_collector)
length = Length(Curve=explode_tree.Branch0)
length_2 = Length(Curve=explode_tree.Branch1)
number = Number(flatten([length, length_2]))
settings = Settings(
    PopulationSize=Slider(10, range=0..50),
    MaxGenerations=Slider(178, range=0..1000),
    EliteSize=Slider(0, range=0..10),
    SelectionStrategy=stochastic_universal_sampling,
    PairingStrategy=inbreeding_pairing,
    MutationStrategy=fixed_value_mutation)
curve_3 = Curve(explode_tree.Branch0)
sort_list = SortList(Keys=number, ValuesValuesA=flatten([length, length_2]))  # -> Keys, graft(ValuesValuesA)
evaluate_curve = EvaluateCurve(Curve=reparameterize_curve.Reparameterized, Parameter=number_slider)  # -> Point, Tangent, Angle
explode_tree_2 = ExplodeTree(Data=simplify(sort_list.ValuesValuesA))  # -> Branch0, Branch1
division = Division(A=explode_tree_2.Branch0, B=explode_tree_2.Branch1)
fitness = Fitness(Fitness=division)
basic_solver = BasicSolver(Genes=text, Settings=settings, PreviewLevel=0, Run=Button())  # -> Observer, StateManager, CurrentGeneration, IsRunning
observer = Observer(Observer=basic_solver.Observer)  # -> Individuals, AverageFitness, BestFitness, WorstFitness, BestIndividual
individual = Individual(Individual=observer.BestIndividual)  # -> Fitness, Genes
decode_gene = DecodeGene(Gene=individual.Genes)  # -> GeneName, flatten(GeneValue), GeneGuid
panel = Panel(decode_gene.GeneValue)
loop_end = LoopEnd(port=loop_start.port, Exit=False, Data=curve_3, TimeOutVal=0, pausedState=False, state="Constant output")  # -> flatten(Data)
panel_2 = Panel(loop_end)
