# Grasshopper definition test_evol_0.03.gh (Grasshopper 1.0.8)
# plug-ins: Geospiza, Pufferfish, Anemone

construct_point = ConstructPoint(XCoordinate=0, YCoordinate=0, ZCoordinate=0)
construct_point_2 = ConstructPoint(XCoordinate=Slider(120, range=0..1000), YCoordinate=0, ZCoordinate=0)
line = Line(StartPoint=construct_point, EndPoint=construct_point_2)
curve = Curve(line)
loop_start = LoopStart(Repeat=Slider(2, range=0..10), Trigger=Button(), Data=curve)  # -> port, Counter, Data
curve_2 = Curve(loop_start.Data)
number_slider = Slider(0.5, range=0..1)
reparameterize_curve = ReparameterizeCurve(Curve=curve_2)  # -> Reparameterized, Original
shatter = Shatter(Curve=reparameterize_curve.Reparameterized, Parameters=number_slider)  # -> graft(Segments)
gene_collector = GeneCollector()
explode_tree = ExplodeTree(Data=simplify(shatter))  # -> Branch0, Branch1
stochastic_universal_sampling = StochasticUniversalSampling()
fixed_value_mutation = FixedValueMutation(MutationRate=0.01, MutationValue=Slider(1, range=0..1))
inbreeding_pairing = InbreedingPairing(InBreedingFactor=Slider(0.05, range=0..0.8), DistanceFunction=1)
text = Text(gene_collector)
length = Length(Curve=explode_tree.Branch0)
length_2 = Length(Curve=explode_tree.Branch1)
number = Number(flatten([length, length_2]))
settings = Settings(
    PopulationSize=Slider(35, range=0..50),
    MaxGenerations=Slider(400, range=0..1000),
    EliteSize=Slider(0, range=0..10),
    SelectionStrategy=stochastic_universal_sampling,
    PairingStrategy=inbreeding_pairing,
    MutationStrategy=fixed_value_mutation)
curve_3 = Curve(explode_tree.Branch0)
sort_list = SortList(Keys=number, ValuesValuesA=flatten([length, length_2]))  # -> Keys, graft(ValuesValuesA)
explode_tree_2 = ExplodeTree(Data=simplify(sort_list.ValuesValuesA))  # -> Branch0, Branch1
division = Division(A=explode_tree_2.Branch0, B=explode_tree_2.Branch1)
fitness = Fitness(Fitness=division)
basic_solver = BasicSolver(Genes=text, Settings=settings, PreviewLevel=0, Run=False)  # -> Observer, StateManager, CurrentGeneration, IsRunning
observer = Observer(Observer=basic_solver.Observer)  # -> Individuals, AverageFitness, BestFitness, WorstFitness, BestIndividual
individual = Individual(Individual=observer.BestIndividual)  # -> Fitness, Genes
decode_gene = DecodeGene(Gene=individual.Genes)  # -> GeneName, flatten(GeneValue), GeneGuid
panel = Panel(decode_gene.GeneValue)
loop_end = LoopEnd(port=loop_start.port, Exit=False, Data=curve_3, TimeOutVal=0, pausedState=False, state="Constant & Record")  # -> flatten(Data)
list_item = ListItem(List=loop_end, Index=Slider(67, range=0..100), Wrap=True)
evaluate_curve = EvaluateCurve(Curve=loop_end, Parameter=number_slider)  # -> Point, Tangent, Angle
panel_2 = Panel(loop_end)
