# Grasshopper definition test_evol_0.04.gh (Grasshopper 1.0.8)
# plug-ins: Geospiza, Pufferfish, Anemone

python_3_script = Python3Script()  # -> out, a
# ---------- python_3_script: Python ----------
# Grasshopper Python script to generate a pulse when a loop restarts

if not 'last_count' in globals():
    last_count = -1
    pulse = False

# Read the input (ensure you connect an integer counter from Anemone)
loop_count = int(x)  # Connect Anemone loop count to 'x' input

# Check if the loop has restarted (increment detected)
if loop_count > last_count:
    pulse = True  # Set pulse to True momentarily
    last_count = loop_count  # Update last count

else:
    pulse = False  # Ensure it's False otherwise

# Output the pulse
a = pulse
# ---------- end python_3_script ----------
python_3_script_2 = Python3Script()  # -> out, a; same code as python_3_script
construct_point = ConstructPoint(XCoordinate=0, YCoordinate=0, ZCoordinate=0)
construct_point_2 = ConstructPoint(XCoordinate=Slider(120, range=0..1000), YCoordinate=0, ZCoordinate=0)
line = Line(StartPoint=construct_point, EndPoint=construct_point_2)
boolean_toggle = BooleanToggle(True)
loop_start = LoopStart(Repeat=Slider(2, range=0..10), Trigger=Button(), Data=line)  # -> port, Counter, Data
toggle = BooleanToggle(False)

# ---- group: input
panel = Panel("5")

# ----
curve = Curve(loop_start.Data)
loop_start_2 = LoopStart(Repeat=panel, Trigger=panel, Data=loop_start.Counter)  # -> port, Counter, Data
python_3_script_3 = Python3Script(x=loop_start.Counter)  # -> out, a; disabled
# ---------- python_3_script_3: Python ----------
import time

# Ensure Counter is defined
try:
    Counter  # Check if Counter is passed as an input
except NameError:
    Counter = 0  # Default to 0 if not set

# Initialize stored values if they don't exist
if 'prev_counter' not in globals():
    globals()['prev_counter'] = -1
    globals()['trigger_time'] = 0
    globals()['state'] = False

# Detect a new loop iteration
if Counter > globals()['prev_counter']:
    globals()['prev_counter'] = Counter  # Update the counter
    globals()['trigger_time'] = time.time()  # Store timestamp
    globals()['state'] = True  # Set output to True briefly

# Maintain True for a short duration (simulate a pulse)
if time.time() - globals()['trigger_time'] < 0.3:  # 100ms pulse
    a = True
else:
    a = False  # Reset to False after pulse duration
# ---------- end python_3_script_3 ----------
loop_end = LoopEnd(port=loop_start_2.port, Exit=False, Data=loop_start_2.Data, TimeOutVal=0, pausedState=False, state="Output last")
panel_2 = Panel(loop_start_2.Counter)
smaller = SmallerThan(FirstNumber=loop_start_2.Counter, SecondNumber=panel)  # -> SmallerThan, OrEqualTo
python_3_script_4 = Python3Script(x=loop_start.Counter)  # -> out, a
# ---------- python_3_script_4: Python ----------
import rhinoscriptsyntax as rs
import scriptcontext as sc
import Rhino

# Input parameter x (counter from loop)
x = x  # This is the input from Grasshopper

# We need two keys:
# 1. To track the previous counter value
# 2. To track whether we've already pulsed for this counter value
counter_key = "pulse_previous_counter"
pulsed_key = "already_pulsed_for_counter"

# Initialize if first run
if not sc.sticky.has_key(counter_key):
    sc.sticky[counter_key] = -999  # Start with unlikely value

if not sc.sticky.has_key(pulsed_key):
    sc.sticky[pulsed_key] = False

# Get values from sticky
previous_counter = sc.sticky[counter_key]
already_pulsed = sc.sticky[pulsed_key]

# Output value (initialize as False)
pulse = False

# Check if counter has changed
if x != previous_counter:
    # Counter changed - new iteration detected
    sc.sticky[counter_key] = x  # Store new counter value
    sc.sticky[pulsed_key] = True  # Mark that we've pulsed for this counter
    pulse = True  # Send pulse signal
else:
    # Same counter value, keep signal off
    pulse = False
    sc.sticky[pulsed_key] = False  # Reset pulse flag

# Output the pulse value
a = pulse
# ---------- end python_3_script_4 ----------
data_recorder = DataRecorder(python_3_script_4.a, DataLimit=-10, RecordData=True)
panel_3 = Panel(smaller.SmallerThan)
curve_2 = Curve(curve)
panel_4 = Panel(data_recorder)
number_slider = Slider(0.4961, range=0..1)
reparameterize_curve = ReparameterizeCurve(Curve=curve_2)  # -> Reparameterized, Original
shatter = Shatter(Curve=reparameterize_curve.Reparameterized, Parameters=number_slider)  # -> graft(Segments)
gene_collector = GeneCollector(GeneParams=number_slider)
explode_tree = ExplodeTree(Data=simplify(shatter))  # -> Branch0, Branch1
stochastic_universal_sampling = StochasticUniversalSampling()
fixed_value_mutation = FixedValueMutation(MutationRate=0.01, MutationValue=Slider(0.01, range=0..1))
inbreeding_pairing = InbreedingPairing(InBreedingFactor=Slider(0.05, range=0..0.8), DistanceFunction=1)
text = Text(gene_collector)
length = Length(Curve=explode_tree.Branch0)
length_2 = Length(Curve=explode_tree.Branch1)
number = Number(flatten([length, length_2]))
settings = Settings(
    PopulationSize=Slider(40, range=0..50),
    MaxGenerations=Slider(330, range=0..1000),
    EliteSize=Slider(0, range=0..10),
    SelectionStrategy=stochastic_universal_sampling,
    PairingStrategy=inbreeding_pairing,
    MutationStrategy=fixed_value_mutation)
curve_3 = Curve(explode_tree.Branch0)
sort_list = SortList(Keys=number, ValuesValuesA=flatten([length, length_2]))  # -> Keys, graft(ValuesValuesA)
evaluate_curve = EvaluateCurve(Curve=reparameterize_curve.Reparameterized, Parameter=number_slider)  # -> Point, Tangent, Angle
explode_tree_2 = ExplodeTree(Data=simplify(sort_list.ValuesValuesA))  # -> Branch0, Branch1
stream_gate = StreamGate(Stream=text, Gate=python_3_script_4.a)  # -> Target0, Target1
division = Division(A=explode_tree_2.Branch0, B=explode_tree_2.Branch1)
boolean_toggle_2 = BooleanToggle(False)
boolean_toggle_3 = BooleanToggle(True)
fitness = Fitness(Fitness=division)
basic_solver = BasicSolver(Genes=text, Settings=settings, PreviewLevel=0, Run=smaller.SmallerThan)  # -> Observer, StateManager, CurrentGeneration, IsRunning
observer = Observer(Observer=basic_solver.Observer)  # -> Individuals, AverageFitness, BestFitness, WorstFitness, BestIndividual
individual = Individual(Individual=observer.BestIndividual)  # -> Fitness, Genes
decode_gene = DecodeGene(Gene=individual.Genes)  # -> GeneName, flatten(GeneValue), GeneGuid
panel_5 = Panel(decode_gene.GeneValue)
loop_end_2 = LoopEnd(port=loop_start.port, Exit=False, Data=curve_3, TimeOutVal=0, pausedState=False, state="Constant & Record")  # -> flatten(Data)
list_item = ListItem(List=loop_end_2, Index=Slider(2, range=0..2), Wrap=True)
panel_6 = Panel(loop_end_2)
