# Grasshopper definition test_evol_0.06.gh (Grasshopper 1.0.8)
# plug-ins: Geospiza, Pufferfish

construct_point = ConstructPoint(XCoordinate=0, YCoordinate=0, ZCoordinate=0)
construct_point_2 = ConstructPoint(XCoordinate=Slider(120, range=0..1000), YCoordinate=0, ZCoordinate=0)
line = Line(StartPoint=construct_point, EndPoint=construct_point_2)
curve = Curve(line)
curve_2 = Curve(curve)
number_slider = Slider(0.352, range=0..0.99)
reparameterize_curve = ReparameterizeCurve(Curve=curve_2)  # -> Reparameterized, Original
shatter = Shatter(Curve=reparameterize_curve.Reparameterized, Parameters=number_slider)  # -> graft(Segments)
stochastic_universal_sampling = StochasticUniversalSampling()
gene_collector = GeneCollector(GeneParams=number_slider)
inbreeding_pairing = InbreedingPairing(InBreedingFactor=Slider(0.05, range=0..0.8), DistanceFunction=1)
explode_tree = ExplodeTree(Data=simplify(shatter))  # -> Branch0, Branch1
fixed_value_mutation = FixedValueMutation(MutationRate=0.01, MutationValue=Slider(0.1, range=0..1))
text = Text(gene_collector)
length = Length(Curve=explode_tree.Branch0)
length_2 = Length(Curve=explode_tree.Branch1)
end_points = EndPoints(Curve=explode_tree.Branch0)  # -> Start, End
galapagos = Galapagos()
number = Number(flatten([length, length_2]))
settings = Settings(
    PopulationSize=Slider(40, range=0..50),
    MaxGenerations=Slider(330, range=0..1000),
    EliteSize=Slider(0, range=0..10),
    SelectionStrategy=stochastic_universal_sampling,
    PairingStrategy=inbreeding_pairing,
    MutationStrategy=fixed_value_mutation)
sort_list = SortList(Keys=number, ValuesValuesA=flatten([length, length_2]))  # -> Keys, graft(ValuesValuesA)
explode_tree_2 = ExplodeTree(Data=simplify(sort_list.ValuesValuesA))  # -> Branch0, Branch1
division = Division(A=explode_tree_2.Branch0, B=explode_tree_2.Branch1)
fitness = Fitness(Fitness=division)
basic_solver = BasicSolver(Genes=text, Settings=settings, PreviewLevel=0, Run=Button())  # -> Observer, StateManager, CurrentGeneration, IsRunning
observer = Observer(Observer=basic_solver.Observer)  # -> Individuals, AverageFitness, BestFitness, WorstFitness, BestIndividual
