# Grasshopper definition test_evol_0.07.gh (Grasshopper 1.0.8)
# plug-ins: Geospiza, Pufferfish

construct_point = ConstructPoint(XCoordinate=0, YCoordinate=0, ZCoordinate=0)
construct_point_2 = ConstructPoint(XCoordinate=Slider(120, range=0..1000), YCoordinate=0, ZCoordinate=0)
line = Line(StartPoint=construct_point, EndPoint=construct_point_2)
curve = Curve(line)
curve_2 = Curve(curve)
number_slider = Slider(0.8426, range=0..1)
reparameterize_curve = ReparameterizeCurve(Curve=curve_2)  # -> Reparameterized, Original
shatter = Shatter(Curve=reparameterize_curve.Reparameterized, Parameters=number_slider)  # -> graft(Segments)
gene_collector = GeneCollector(GeneParams=number_slider)
explode_tree = ExplodeTree(Data=simplify(shatter))  # -> Branch0, Branch1
stochastic_universal_sampling = StochasticUniversalSampling()
fixed_value_mutation = FixedValueMutation(MutationRate=0.01, MutationValue=Slider(0.01, range=0..1))
inbreeding_pairing = InbreedingPairing(InBreedingFactor=Slider(0.05, range=0..0.8), DistanceFunction=1)
text = Text(gene_collector)
length = Length(Curve=explode_tree.Branch0)
length_2 = Length(Curve=explode_tree.Branch1)
number = Number(flatten([length, length_2]))
end_points = EndPoints(Curve=explode_tree.Branch0)  # -> Start, End
settings = Settings(
    PopulationSize=Slider(40, range=0..50),
    MaxGenerations=Slider(330, range=0..1000),
    EliteSize=Slider(0, range=0..10),
    SelectionStrategy=stochastic_universal_sampling,
    PairingStrategy=inbreeding_pairing,
    MutationStrategy=fixed_value_mutation)
curve_3 = Curve(explode_tree.Branch0)
sort_list = SortList(Keys=number, ValuesValuesA=flatten([length, length_2]))  # -> Keys, graft(ValuesValuesA)
point = Point()
explode_tree_2 = ExplodeTree(Data=simplify(sort_list.ValuesValuesA))  # -> Branch0, Branch1
list_length = ListLength(List=point)
division = Division(A=explode_tree_2.Branch0, B=explode_tree_2.Branch1)
negative = Negative(Value=division)
addition = Addition(A=division, B=1)
basic_solver = BasicSolver(Genes=text, Settings=settings, PreviewLevel=0, Run=Button())  # -> Observer, StateManager, CurrentGeneration, IsRunning
one_over_x = OneOverX(Value=addition)
fitness = Fitness(Fitness=one_over_x)
