# Grasshopper definition Iso_0.01.gh (Grasshopper 1.0.7)
# plug-ins: Nautilus, Stripper, Pufferfish, LunchBox, Python

brep = Brep(<brep referenced from the Rhino model>)
mesh = MeshBrep(
    Brep=brep,
    Settings={GridMaxCount=0, GridMinCount=16, JaggedSeams=False, MaxEdgeLength=0, MinEdgeLength=0.0001, MinTolerance=0, Refine=True, RefineAngle=0, RelativeTolerance=0.65, SimplePlanes=True, Tolerance=0})
# Import
mesh_2 = Mesh(<mesh referenced from the Rhino model>)
mesh_3 = Mesh(mesh)

# ----
# Remesh
# Remesh organic
parameters = QuadRemeshParameters(
    TargetQuadCount=Slider(500, range=0..10000),
    UseAdaptiveQuads=Toggle(True),
    AdaptiveQuadSize=Slider(29, range=0..100),
    DetectHardEdges=True,
    PreserveMeshArrayHardEdges=Slider(1, range=0..2),
    SymmetryAxis=0,
    GuideCurveInfluence=Slider(0, range=0..2),
    TargetEdgeLength=0)
mesh_4 = Mesh(mesh_3)
# Slowest part of the code
remesh = QuadRemesh(MeshOrBrep=mesh_4, QuadRemeshParameters=parameters)
joinweldmesh = JoinWeldMeshes(Meshes=remesh)

bbox = BoundingBox(Content=joinweldmesh, Plane=PlaneXY(0, 0, 0))  # -> Box, Box_2
# Auto position to centre
volume = Volume(Geometry=bbox.Box)  # -> Volume, Centroid
pt = ConstructPoint(XCoordinate=0, YCoordinate=0, ZCoordinate=0)
vec2pt = Vector2Pt(PointA=volume.Centroid, PointB=pt, Unitize=False)  # -> Vector, Length
move = Move(Geometry=joinweldmesh, Motion=vec2pt.Vector)  # -> Geometry, Transform
move_2 = Move(Geometry=volume.Centroid, Motion=vec2pt.Vector)  # -> Geometry, Transform

# ----
# User rotation
xy = XYPlane(Origin=move_2.Geometry)
rotworld = RotateWorld(
    Geometry=move.Geometry,
    Plane=xy,
    Axis1=0,
    Axis2=1,
    Axis3=2,
    Degrees1=Slider(0, range=-180..180),
    Degrees2=Slider(0, range=-180..180),
    Degrees3=Slider(0, range=-180..180))  # -> Rotated, Plane1, Plane2, Plane3, Transform

# ----
# Prevents plane from being invalid
number_slider = Slider(0, range=0..1)
number_slider_2 = Slider(0, range=0..1)
number_slider_3 = Slider(0, range=0..1)
# Major pull direction
ma = MassAddition(Input=[number_slider, number_slider_2, number_slider_3])  # -> Result, PartialResults
equals = Equality(FirstNumber=ma.Result, SecondNumber="0")  # -> Equality, Inequality
multiplication = Multiplication(A="0.001", B=equals.Equality)
addition = Addition(A=multiplication, B=number_slider)

addition_2 = Addition(A=multiplication, B=number_slider_2)
# Prevents plane from being invalid
addition_3 = Addition(A=multiplication, B=number_slider_3)

vec = VectorXYZ(XComponent=addition, YComponent=addition_2, ZComponent=addition_3)  # -> unitize(Vector), Length
pl = PlaneNormal(Origin=Point(0, 0, 0), ZAxis=vec.Vector)

line_sdl = LineSDL(Start=pl, Direction=vec.Vector, Length=Slider(6, range=0..100))

demesh = DeconstructMesh(Mesh=rotworld.Rotated)  # -> Vertices, Faces, Colours, Normals
# Determine relation mesh and pull direction
meshcp = MeshClosestPoint(Point=demesh.Vertices, Mesh=rotworld.Rotated)  # -> Point, Index, Parameter
meval = MeshEval(Mesh=rotworld.Rotated, Parameter=meshcp.Parameter)  # -> Point, Normal, Colour
dprod = DotProduct(VectorA=meval.Normal, VectorB=vec.Vector, Unitize=False)
meshisosplitext = MeshIsoSplittingToMeshesExt(
    Mesh=rotworld.Rotated,
    VertexWeights=dprod,
    IsoValues="0",
    Tolerance=1e-06,
    Parallel=True,
    Power=-2,
    Seed=Slider(21, range=0..100),
    Color_Meshes=True)

disjoint = DisjointMesh(Mesh=flatten(meshisosplitext))  # -> flatten(Meshes)

# ----
# Filter noise meshes
face_count = MeshFaceCount(Mesh=disjoint)
larger = LargerThan(FirstNumber=face_count, SecondNumber="25")  # -> LargerThan, OrEqualTo
cull = CullPattern(List=disjoint, CullPattern=larger.LargerThan)

demesh_2 = DeconstructMesh(Mesh=cull)  # -> Vertices, Faces, Colours, Normals
# Filter mesh by color
cset = CreateSet(List=demesh_2.Colours)  # -> flatten(Set), Map
panel = Panel(cset.Set)
item = ListItem(List=cset.Set, Index=0, Wrap=True)
equals_2 = Equality(FirstNumber=item, SecondNumber=cset.Set)  # -> Equality, Inequality

dispatch = Dispatch(List=cull, DispatchPattern=equals_2.Equality)  # -> ListA, ListB
lng = ListLength(List=dispatch.ListA)
# Get color with most meshes
lng_2 = ListLength(List=dispatch.ListB)
larger_2 = LargerThan(FirstNumber=lng, SecondNumber=lng_2)  # -> LargerThan, OrEqualTo
invbool = InvertBoolean(Boolean=larger_2.LargerThan)  # -> Inverted, Number
filter = StreamFilter(Gate=invbool.Inverted, Stream0=dispatch.ListA, Stream1=dispatch.ListB)

nocolor = MeshRemoveColor(Mesh=filter)
# Finish mesh
number_slider_4 = Slider(2, range=0..20)
smooth_boundary = SmoothMeshBoundaryEdges(Mesh=nocolor, Level=number_slider_4, Intensity=1)
