# Grasshopper definition Iso_0.03.gh (Grasshopper 1.0.7)
# plug-ins: Nautilus, Stripper, Pufferfish, LunchBox, LunchBoxML, Anemone

brep = Brep(<brep referenced from the Rhino model>)
mesh = MeshBrep(
    Brep=brep,
    Settings={GridMaxCount=0, GridMinCount=16, JaggedSeams=False, MaxEdgeLength=0, MinEdgeLength=0.0001, MinTolerance=0, Refine=True, RefineAngle=0, RelativeTolerance=0.65, SimplePlanes=True, Tolerance=0})
# Import
mesh_2 = Mesh(<mesh referenced from the Rhino model>)
mesh_3 = Mesh(mesh)

# ----
# Remesh
# Remesh organic
parameters = QuadRemeshParameters(
    TargetQuadCount=Slider(500, range=0..10000),
    UseAdaptiveQuads=Toggle(True),
    AdaptiveQuadSize=Slider(29, range=0..100),
    DetectHardEdges=True,
    PreserveMeshArrayHardEdges=Slider(1, range=0..2),
    SymmetryAxis=0,
    GuideCurveInfluence=Slider(0, range=0..2),
    TargetEdgeLength=0)
mesh_4 = Mesh(mesh_3)
# Slowest part of the code
remesh = QuadRemesh(MeshOrBrep=mesh_4, QuadRemeshParameters=parameters)

weld_the_vertices_of_a_mesh = WeldTheVerticesOfAMesh(Mesh=remesh, Tolerance=0.001)

bbox = BoundingBox(Content=weld_the_vertices_of_a_mesh, Plane=PlaneXY(0, 0, 0))  # -> Box, Box_2
# Auto position to centre
volume = Volume(Geometry=bbox.Box)  # -> Volume, Centroid
pt = ConstructPoint(XCoordinate=0, YCoordinate=0, ZCoordinate=0)
vec2pt = Vector2Pt(PointA=volume.Centroid, PointB=pt, Unitize=False)  # -> Vector, Length
move = Move(Geometry=weld_the_vertices_of_a_mesh, Motion=vec2pt.Vector)  # -> Geometry, Transform
move_2 = Move(Geometry=volume.Centroid, Motion=vec2pt.Vector)  # -> Geometry, Transform

# ----
# User rotation
xy = XYPlane(Origin=move_2.Geometry)
rotworld = RotateWorld(
    Geometry=move.Geometry,
    Plane=xy,
    Axis1=0,
    Axis2=1,
    Axis3=2,
    Degrees1=Slider(0, range=-180..180),
    Degrees2=Slider(0, range=-180..180),
    Degrees3=Slider(0, range=-180..180))  # -> Rotated, Plane1, Plane2, Plane3, Transform

deconstruct_mesh = DeconstructMesh(Mesh=rotworld.Rotated)  # -> Vertices, Faces, Colours, Normals
face_normals = FaceNormals(Mesh=rotworld.Rotated)  # -> Centers, Normals
amplitude = Amplitude(Vector=face_normals.Normals, Amplitude=Slider(20, range=0..100))
vector_display = VectorDisplay(Anchor=face_normals.Centers, Vector=amplitude)
k_means_clustering = KMeansClustering(TrainingInputs=graft(deconstruct_mesh.Normals), OfClusters=Slider(4, range=0..10), RandomSeed=5)  # -> Result, Likelihood, Centroids
create_set = CreateSet(List=k_means_clustering.Result)  # -> Set, Map
last_index = LastIndex(List=create_set.Set)
loop_start = LoopStart(Repeat=last_index, Trigger=Toggle(True), Data=deconstruct_mesh.Vertices)  # -> port, Counter, Data
list_item = ListItem(List=create_set.Set, Index=loop_start.Counter, Wrap=True)
equality = Equality(FirstNumber=k_means_clustering.Result, SecondNumber=list_item)  # -> Equality, Inequality
cull_pattern = CullPattern(List=deconstruct_mesh.Vertices, CullPattern=equality.Equality)
loop_end = LoopEnd(port=loop_start.port, Exit=False, Data=cull_pattern, TimeOutVal=0, pausedState=False, state="Constant & Record")
panel = Panel(loop_end)
# Filter mesh by color
explode_tree = ExplodeTree(Data=simplify(loop_end))  # -> Branch0, Branch1, Branch2, Branch3
point = Point(explode_tree.Branch3)

# ----
# Prevents plane from being invalid
number_slider = Slider(0, range=0..1)
number_slider_2 = Slider(0.45, range=0..1)
number_slider_3 = Slider(0.67, range=0..1)
# Major pull direction
ma = MassAddition(Input=[number_slider, number_slider_2, number_slider_3])  # -> Result, PartialResults
equals = Equality(FirstNumber=ma.Result, SecondNumber="0")  # -> Equality, Inequality
multiplication = Multiplication(A="0.001", B=equals.Equality)
addition = Addition(A=multiplication, B=number_slider)

addition_2 = Addition(A=multiplication, B=number_slider_2)
# Prevents plane from being invalid
addition_3 = Addition(A=multiplication, B=number_slider_3)

vec = VectorXYZ(XComponent=addition, YComponent=addition_2, ZComponent=addition_3)  # -> unitize(Vector), Length
pl = PlaneNormal(Origin=Point(0, 0, 0), ZAxis=vec.Vector)

line_sdl = LineSDL(Start=pl, Direction=vec.Vector, Length=Slider(6, range=0..100))

demesh = DeconstructMesh(Mesh=rotworld.Rotated)  # -> Vertices, Faces, Colours, Normals; disabled
# Determine relation mesh and pull direction
meshcp = MeshClosestPoint(Point=demesh.Vertices, Mesh=rotworld.Rotated)  # -> Point, Index, Parameter; disabled
meval = MeshEval(Mesh=rotworld.Rotated, Parameter=meshcp.Parameter)  # -> Point, Normal, Colour; disabled
panel_2 = Panel("0")  # disabled
number_slider_4 = Slider(21, range=0..100)  # disabled
dprod = DotProduct(VectorA=meval.Normal, VectorB=vec.Vector, Unitize=False)  # disabled
meshisosplitext = MeshIsoSplittingToMeshesExt(
    Mesh=rotworld.Rotated,
    VertexWeights=dprod,
    IsoValues=panel_2,
    Tolerance=1e-06,
    Parallel=True,
    Power=-2,
    Seed=number_slider_4,
    Color_Meshes=True)  # disabled

disjoint = DisjointMesh(Mesh=flatten(meshisosplitext))  # -> flatten(Meshes); disabled

# ----
# Filter noise meshes
panel_3 = Panel("25")  # disabled
face_count = MeshFaceCount(Mesh=disjoint)  # disabled
larger = LargerThan(FirstNumber=face_count, SecondNumber=panel_3)  # -> LargerThan, OrEqualTo; disabled
cull = CullPattern(List=disjoint, CullPattern=larger.LargerThan)  # disabled

demesh_2 = DeconstructMesh(Mesh=cull)  # -> Vertices, Faces, Colours, Normals; disabled
cset = CreateSet(List=demesh_2.Colours)  # -> flatten(Set), Map; disabled
panel_4 = Panel(cset.Set)  # disabled
item = ListItem(List=cset.Set, Index=0, Wrap=True)  # disabled
equals_2 = Equality(FirstNumber=item, SecondNumber=cset.Set)  # -> Equality, Inequality; disabled

dispatch = Dispatch(List=cull, DispatchPattern=equals_2.Equality)  # -> ListA, ListB; disabled
lng = ListLength(List=dispatch.ListA)  # disabled
# Get color with most meshes
lng_2 = ListLength(List=dispatch.ListB)  # disabled
larger_2 = LargerThan(FirstNumber=lng, SecondNumber=lng_2)  # -> LargerThan, OrEqualTo; disabled
invbool = InvertBoolean(Boolean=larger_2.LargerThan)  # -> Inverted, Number; disabled
filter = StreamFilter(Gate=invbool.Inverted, Stream0=dispatch.ListA, Stream1=dispatch.ListB)  # disabled

nocolor = MeshRemoveColor(Mesh=filter)  # disabled
# Finish mesh
number_slider_5 = Slider(2, range=0..20)  # disabled
smooth_boundary = SmoothMeshBoundaryEdges(Mesh=nocolor, Level=number_slider_5, Intensity=1)  # disabled
