# Grasshopper definition Mould_0.10.gh (Grasshopper 1.0.7)
# plug-ins: Pufferfish, Heteroptera, Kangaroo2 Components, Python, NGon

brep = Brep(<brep referenced from the Rhino model>)
# Import mesh or brep
mesh = MeshBrep(
    Brep=brep,
    Settings={GridMaxCount=0, GridMinCount=16, JaggedSeams=False, MaxEdgeLength=0, MinEdgeLength=0.0001, MinTolerance=0, Refine=True, RefineAngle=0, RelativeTolerance=0.65, SimplePlanes=True, Tolerance=0})
mesh_2 = Mesh(mesh)
mesh_3 = Mesh(<mesh referenced from the Rhino model>)

mesh_4 = Mesh([mesh_3, mesh_2])

bbox = BoundingBox(Content=mesh_4, Plane=PlaneXY(0, 0, 0))  # -> Box, Box_2
volume = Volume(Geometry=bbox.Box)  # -> Volume, Centroid
pt = ConstructPoint(XCoordinate=0, YCoordinate=0, ZCoordinate=0)
vec2pt = Vector2Pt(PointA=volume.Centroid, PointB=pt, Unitize=False)  # -> Vector, Length
move = Move(Geometry=mesh_4, Motion=vec2pt.Vector)  # -> Geometry, Transform
# Automatically orient to the CS centre
move_2 = Move(Geometry=volume.Centroid, Motion=vec2pt.Vector)  # -> Geometry, Transform

xy = XYPlane(Origin=move_2.Geometry)
rotworld = RotateWorld(
    Geometry=move.Geometry,
    Plane=xy,
    Axis1=0,
    Axis2=1,
    Axis3=2,
    Degrees1=Slider(0, range=-180..180),
    Degrees2=Slider(0, range=-180..180),
    Degrees3=Slider(0, range=-180..180))  # -> Rotated, Plane1, Plane2, Plane3, Transform

mesh_5 = Mesh(rotworld.Rotated)

mesh_face_area = MeshFaceArea(M=mesh_5)  # -> out, G, A, B; inputs M: Mesh
# ---------- mesh_face_area: VB usings ----------
Imports System.IO
Imports System.Linq
Imports System.Data
Imports System.Drawing
Imports System.Reflection
Imports System.Windows.Forms
Imports System.Xml
Imports System.Xml.Linq
Imports Microsoft.VisualBasic
Imports System.Runtime.InteropServices

Imports Rhino.DocObjects
Imports Rhino.Collections
Imports GH_IO
Imports GH_IO.Serialization
# ---------- mesh_face_area: VB ----------
    Component.Params.Input(0).Name = "Mesh"
    Component.Params.Input(0).Description = "Open or closed mesh"
    Component.Params.Input(1).Name = "Area Domain"
    Component.Params.Input(1).Description = "The domain that describes the range of areas to be tested against"

    Component.Params.Output(1).Name = "Preview Mesh"
    Component.Params.Output(1).Description = "A greyscale preview mesh reflecting the range of values"
    Component.Params.Output(2).Name = "Areas"
    Component.Params.Output(2).Description = "The area of each face of the mesh"
    Component.Params.Output(3).Name = "Pattern"
    Component.Params.Output(3).Description = "If the R input is used, the status of each sample point relative to the provided range (0 = Below, 1 = Within, 2 = Above)"

    If M IsNot Nothing Then
      Dim i,j,k,s As Integer

      Dim mf As Rhino.Geometry.Collections.MeshFaceList = Nothing
      Dim mfn As Rhino.Geometry.Collections.MeshFaceNormalList = Nothing
      Dim mv As Rhino.Geometry.Collections.MeshVertexList = Nothing
      Dim mtv As Rhino.Geometry.Collections.MeshTopologyVertexList = Nothing
      Dim mte As Rhino.Geometry.Collections.MeshTopologyEdgeList = Nothing
      Dim mn As Rhino.Geometry.Collections.MeshVertexNormalList = Nothing
      Dim mc As Rhino.Geometry.Collections.MeshVertexColorList = Nothing

      mf = m.Faces
      mfn = m.FaceNormals
      mv = m.Vertices
      mtv = m.TopologyVertices
      mte = m.TopologyEdges
      mn = m.Normals
      mc = m.VertexColors

      Dim arrArea As New list(Of Double)
      Dim oc As New list(Of color)
      Dim tv,farea,Tmin,Tmax As Double
      Dim arrPat As New list(Of Integer)

      Dim mfo As New list(Of MeshFace)
      Dim mvo As New list(Of point3d)

      For i = 0 To mf.count() - 1 Step 1
        s = mvo.count()
        Dim tm As New mesh
        Dim tmf As Rhino.Geometry.Collections.MeshFaceList = Nothing
        tmf = tm.Faces()
        tmf.AddFace(mf.item(i))
        tm.Vertices.AddVertices(mv)

        farea = Rhino.Geometry.AreaMassProperties.Compute(tm).Area
        arrArea.add(farea)

        If mf.item(i).isquad() Then
          mvo.add(mv.item(mf.item(i).A))
          mvo.add(mv.item(mf.item(i).B))
          mvo.add(mv.item(mf.item(i).C))
          mvo.add(mv.item(mf.item(i).D))
          mfo.add(New meshface(s, s + 1, s + 2, s + 3))
          k = 4
        Else
          mvo.add(mv.item(mf.item(i).A))
          mvo.add(mv.item(mf.item(i).B))
          mvo.add(mv.item(mf.item(i).C))
          mfo.add(New meshface(s, s + 1, s + 2))
          k = 3
        End If

        If i = 0 Then Tmin = farea Else If farea < Tmin Then Tmin = farea
        If farea > Tmax Then Tmax = farea
      Next

      If R = Nothing Then
        R.t0 = Tmin
        R.t1 = Tmax
      End If

      For i = 0 To mf.count() - 1 Step 1
        If mf.item(i).isquad() Then k = 4 Else k = 3

        If arrArea.item(i) < R.T0 Then
          For j = 0 To k - 1 Step 1
            oc.add(color.FromArgb(0, 0, 255))
          Next
          arrPat.add(0)
        ElseIf ((arrArea.item(i) > R.T1) Or ((r.t0 = 0) And (r.t1 = 0))) Then
          For j = 0 To k - 1 Step 1
            oc.add(color.FromArgb(255, 0, 0))
          Next
          arrPat.add(2)
        Else
          For j = 0 To k - 1 Step 1
            tv = math.Floor((arrArea.item(i) - R.T0) / (R.t1 - R.t0) * 255)
            oc.add(color.FromArgb(tv, tv, tv))
          Next
          arrPat.add(1)
        End If
      Next
      Dim mo As New mesh
      mo.vertices.AddVertices(mvo.toarray())
      mo.Faces.AddFaces(mfo.toarray())
      mo.VertexColors.AppendColors(oc.toarray())

      G = mo
      A = arrArea
      B = arrPat
    End If
# ---------- end mesh_face_area ----------
min_max = MinMax(Number=mesh_face_area.A)  # -> Minimum, Maximum
# check for elongated triangles
number_slider = Slider(2, range=2..50)
division = Division(A=min_max.Maximum, B=min_max.Minimum)
larger_than = LargerThan(FirstNumber=division, SecondNumber=number_slider)  # -> LargerThan, OrEqualTo

deconstruct_mesh = DeconstructMesh(Mesh=mesh_5)  # -> Vertices, Faces, Colours, Normals
# Check for inconsistent face size
number_slider_2 = Slider(150, range=50..500)
# check for low face count
list_length = ListLength(List=deconstruct_mesh.Faces)
smaller_than = SmallerThan(FirstNumber=list_length, SecondNumber=number_slider_2)  # -> SmallerThan, OrEqualTo

face_edge_lengths = FaceEdgeLengths(M=mesh_5, O=0)  # -> out, G, A, V, T, P; inputs M: Mesh
# ---------- face_edge_lengths: VB ----------
    Component.Params.Input(0).Name = "Mesh"
    Component.Params.Input(0).Description = "Open or closed mesh"
    Component.Params.Input(1).Name = "Mode"
    Component.Params.Input(1).Description = "Designates which edge length to check against (0 = Average, 1 = Min, 2 = Max)"
    Component.Params.Input(2).Name = "Length Domain"
    Component.Params.Input(2).Description = "The domain that describes the range of lengths to be tested against"

    Component.Params.Output(1).Name = "Preview Mesh"
    Component.Params.Output(1).Description = "A greyscale preview mesh reflecting the range of values"
    Component.Params.Output(2).Name = "Lengths"
    Component.Params.Output(2).Description = "The length of each face's edge specified by the Mode input"
    Component.Params.Output(3).Name = "Values"
    Component.Params.Output(3).Description = "The list of all associated values to each sample point"
    Component.Params.Output(4).Name = "Topology"
    Component.Params.Output(4).Description = "The list of index values connected to the sample point"
    Component.Params.Output(5).Name = "Pattern"
    Component.Params.Output(5).Description = "If the R input is used, the status of each sample point relative to the provided range (0 = Below, 1 = Within, 2 = Above)"

    If M IsNot Nothing Then
      Dim i,j,k,s As Integer

      Dim iP As Grasshopper.Kernel.IGH_Param = Component.Params.Input(0)
      Dim cP As Grasshopper.Kernel.Data.IGH_Structure = iP.VolatileData

      Dim mf As Rhino.Geometry.Collections.MeshFaceList = Nothing
      Dim mfn As Rhino.Geometry.Collections.MeshFaceNormalList = Nothing
      Dim mv As Rhino.Geometry.Collections.MeshVertexList = Nothing
      Dim mtv As Rhino.Geometry.Collections.MeshTopologyVertexList = Nothing
      Dim mte As Rhino.Geometry.Collections.MeshTopologyEdgeList = Nothing
      Dim mn As Rhino.Geometry.Collections.MeshVertexNormalList = Nothing
      Dim mc As Rhino.Geometry.Collections.MeshVertexColorList = Nothing

      mf = m.Faces
      mfn = m.FaceNormals
      mv = m.Vertices
      mtv = m.TopologyVertices
      mte = m.TopologyEdges
      mn = m.Normals
      mc = m.VertexColors

      Dim avgAng As New list(Of Double)
      Dim arrVal As New datatree(Of Double)
      Dim arrTop As New datatree(Of Integer)
      Dim oc As New list(Of color)
      Dim tv As Integer
      Dim aMin, aMax As Double
      Dim arrPat As New list(Of Integer)

      Dim mfo As New list(Of MeshFace)
      Dim mvo As New list(Of point3d)

      For i = 0 To mf.count() - 1 Step 1
        Dim tcv() As Integer
        tcv = mte.GetEdgesForFace(i)
        s = mvo.count()

        k = ((tcv.Length - 1) + 1)

        If mf.item(i).isquad() Then
          mvo.add(mv.item(mf.item(i).A))
          mvo.add(mv.item(mf.item(i).B))
          mvo.add(mv.item(mf.item(i).C))
          mvo.add(mv.item(mf.item(i).D))
          mfo.add(New meshface(s, s + 1, s + 2, s + 3))
        Else
          mvo.add(mv.item(mf.item(i).A))
          mvo.add(mv.item(mf.item(i).B))
          mvo.add(mv.item(mf.item(i).C))
          mfo.add(New meshface(s, s + 1, s + 2))
        End If

        Dim tang,ang, tMin, tMax As New Double
        For j = 0 To k - 1 Step 1
          tang = mte.EdgeLine(tcv(j)).Length
          arrVal.add(tang, cp.Path(Component.RunCount - 1).AppendElement(i))
          arrTop.add(tcv(j), cp.Path(Component.RunCount - 1).AppendElement(i))
          ang += tang
          If j = 0 Then tMin = tang Else If tang < tMin Then tMin = tang
          If tang > tMax Then tMax = tang
        Next

        If O = 1 Then
          ang = tMin
        ElseIf O = 2 Then
          ang = tMax
        Else
          ang /= k
        End If

        If i = 0 Then aMin = ang Else If ang < aMin Then aMin = ang
        If ang > aMax Then aMax = ang

        avgAng.add(ang)
      Next

      If R = Nothing Then
        R.t0 = amin
        R.t1 = amax
      End If

      For i = 0 To mf.count() - 1 Step 1
        If mf.item(i).isquad() Then k = 4 Else k = 3

        If avgAng.item(i) < R.T0 Then
          For j = 0 To k - 1 Step 1
            oc.add(color.FromArgb(0, 0, 255))
          Next
          arrPat.add(0)
        ElseIf ((avgAng.item(i) > R.T1) Or ((r.t0 = 0) And (r.t1 = 0))) Then
          For j = 0 To k - 1 Step 1
            oc.add(color.FromArgb(255, 0, 0))
          Next
          arrPat.add(2)
        Else
          For j = 0 To k - 1 Step 1
            tv = math.Floor((avgAng.item(i) - R.T0) / (R.t1 - R.t0) * 255)
            oc.add(color.FromArgb(tv, tv, tv))
          Next
          arrPat.add(1)
        End If
      Next
      Dim mo As New mesh
      mo.vertices.AddVertices(mvo.toarray())
      mo.Faces.AddFaces(mfo.toarray())
      mo.VertexColors.AppendColors(oc.toarray())

      G = mo
      V = arrVal
      A = avgAng
      P = arrPat
      T = arrTop

    End If
# ---------- end face_edge_lengths ----------
min_max_2 = MinMax(Number=face_edge_lengths.V)  # -> Minimum, Maximum
division_2 = Division(A=min_max_2.Maximum, B=min_max_2.Minimum)
larger_than_2 = LargerThan(FirstNumber=division_2, SecondNumber=Slider(7, range=5..10))  # -> LargerThan, OrEqualTo
mass_addition = MassAddition(Input=flatten(larger_than_2.LargerThan))  # -> Result, PartialResults
division_3 = Division(A=list_length, B=Slider(15, range=5..25))
larger_than_3 = LargerThan(FirstNumber=mass_addition.Result, SecondNumber=division_3)  # -> LargerThan, OrEqualTo

# ----
# Is it a bad mesh?
boolean = Boolean([larger_than_3.LargerThan, larger_than.LargerThan, smaller_than.SmallerThan])
# bad mesh yes or no, if yes we'll remesh
mass_addition_2 = MassAddition(Input=boolean)  # -> Result, PartialResults
list_length_2 = ListLength(List=boolean)
smaller_than_2 = SmallerThan(FirstNumber=mass_addition_2.Result, SecondNumber=list_length_2)  # -> SmallerThan, OrEqualTo
panel = Panel(smaller_than_2.SmallerThan)
stream_gate = StreamGate(Stream=mesh_5, Gate=smaller_than_2.SmallerThan)  # -> Target0, Target1

edge_shared_face_angles = EdgeSharedFaceAngles(M=stream_gate.Target1)  # -> out, G, A, T, P
# ---------- edge_shared_face_angles: VB ----------
    Component.Params.Input(0).Name = "Mesh"
    Component.Params.Input(0).Description = "Open or closed mesh"
    Component.Params.Input(1).Name = "Angle Domain"
    Component.Params.Input(1).Description = "The domain that describes the range of angles to be tested against"

    Component.Params.Output(1).Name = "Preview Mesh"
    Component.Params.Output(1).Description = "A greyscale preview mesh reflecting the range of values"
    Component.Params.Output(2).Name = "Angle"
    Component.Params.Output(2).Description = "A list of the angle values between the two faces that share an interior edge, and a value of 0 for naked edges"
    Component.Params.Output(3).Name = "Topology"
    Component.Params.Output(3).Description = "The list of index values connected to the sample point"
    Component.Params.Output(4).Name = "Pattern"
    Component.Params.Output(4).Description = "If the R input is used, the status of each sample point relative to the provided range (0 = Below, 1 = Within, 2 = Above)"

    If M IsNot Nothing Then
      Dim i,j,s As Integer

      Dim iP As Grasshopper.Kernel.IGH_Param = Component.Params.Input(0)
      Dim cP As Grasshopper.Kernel.Data.IGH_Structure = iP.VolatileData

      Dim mf As Rhino.Geometry.Collections.MeshFaceList = Nothing
      Dim mfn As Rhino.Geometry.Collections.MeshFaceNormalList = Nothing
      Dim mv As Rhino.Geometry.Collections.MeshVertexList = Nothing
      Dim mtv As Rhino.Geometry.Collections.MeshTopologyVertexList = Nothing
      Dim mte As Rhino.Geometry.Collections.MeshTopologyEdgeList = Nothing
      Dim mn As Rhino.Geometry.Collections.MeshVertexNormalList = Nothing
      Dim mc As Rhino.Geometry.Collections.MeshVertexColorList = Nothing

      If M.facenormals.count() = 0 Then M.FaceNormals.ComputeFaceNormals()

      mf = m.Faces
      mfn = m.facenormals
      mv = m.Vertices
      mtv = m.TopologyVertices
      mte = m.TopologyEdges
      mn = m.Normals
      mc = m.VertexColors

      Dim avgV As New list(Of Double)
      Dim arrTop As New datatree(Of Integer)
      Dim oc As New list(Of color)
      Dim ovc As New list(Of Point3d)
      Dim omf As New list(Of MeshFace)
      Dim tv As Integer
      Dim ang,tmin,tmax As Double
      Dim arrPat As New list(Of Integer)

      For i = 0 To mte.count() - 1 Step 1
        s = ovc.count()
        Dim ln As line
        ln = mte.EdgeLine(i)
        Dim cfc() As Integer
        cfc = mte.GetConnectedFaces(i)

        If (cfc.Length - 1) = 0 Then
          ang = 0
          arrTop.add(cfc(0), cp.Path(Component.RunCount - 1).AppendElement(i))
        Else
          ang = vector3d.VectorAngle(mfn.item(cfc(0)), mfn.item(cfc(1)))
          arrTop.add(cfc(0), cp.Path(Component.RunCount - 1).AppendElement(i))
          arrTop.add(cfc(1), cp.Path(Component.RunCount - 1).AppendElement(i))
        End If
        ovc.add(ln.From)
        ovc.add(ln.To)
        For j = 0 To (cfc.Length - 1) Step 1
          ovc.add(evalP(ln.To, mf.GetFaceCenter(cfc(j)), 0.25))
          ovc.add(evalP(ln.From, mf.GetFaceCenter(cfc(j)), 0.25))
          omf.add(New meshface(s, s + 1, s + 2 + j * 2, s + 3 + j * 2))
        Next
        If i = 0 Then Tmin = ang Else If ang < Tmin Then Tmin = ang
        If ang > Tmax Then Tmax = ang
        avgV.add(ang)
      Next

      For i = 0 To mte.count() - 1 Step 1
        If R = Nothing Then
          R.t0 = Tmin
          R.t1 = Tmax
        End If

        Dim cfca() As Integer
        cfca = mte.GetConnectedFaces(i)
        If avgV.item(i) < R.T0 Then
          For j = 0 To (cfca.Length - 1) * 2 + 3 Step 1
            oc.add(color.FromArgb(0, 0, 255))
            arrPat.add(0)
          Next
        ElseIf ((avgV.item(i) > R.T1) Or ((R.t0 = 0) And (R.t1 = 0))) Then
          For j = 0 To (cfca.Length - 1) * 2 + 3 Step 1
            oc.add(color.FromArgb(255, 0, 0))
            arrPat.add(2)
          Next
        Else
          For j = 0 To (cfca.Length - 1) * 2 + 3 Step 1
            tv = math.Floor((avgV.item(i) - R.T0) / (R.t1 - R.t0) * 255)
            oc.add(color.FromArgb(tv, tv, tv))
            arrPat.add(1)
          Next
        End If
      Next

      Dim mo As New mesh
      mo.vertices.AddVertices(ovc)
      mo.Faces.AddFaces(omf)
      mo.VertexColors.AppendColors(oc.toarray())

      G = mo
      A = avgV
      P = arrPat
      T = arrTop
    End If
# ---------- edge_shared_face_angles: VB additional code ----------
  Private Function evalP(ByVal op As point3d, ByVal tp As Point3d, ByVal t As Double)
    Return New point3d(op + (tp - op) * t)
  End Function
# ---------- end edge_shared_face_angles ----------
extract_edges = ExtractEdges(M=stream_gate.Target1)  # -> out, L, A, B; inputs M: Mesh
# ---------- extract_edges: VB ----------
    Component.Params.Input(0).Name = "Mesh"
    Component.Params.Input(0).Description = "Open or closed mesh"

    Component.Params.Output(1).Name = "Lines"
    Component.Params.Output(1).Description = "All the edges of the mesh output at lines in topological order"
    Component.Params.Output(2).Name = "Index 1"
    Component.Params.Output(2).Description = "Index of one of the topology vertices which defines the edge"
    Component.Params.Output(3).Name = "Index 2"
    Component.Params.Output(3).Description = "Index of one of the topology vertices which defines the edge"

    If m IsNot Nothing Then
      Dim mte As Rhino.Geometry.Collections.MeshTopologyEdgeList
      Dim arrL As New list(Of line)
      Dim arrI, arrJ As New list(Of Integer)
      Dim i As Integer

      mte = M.TopologyEdges()

      For i = 0 To mte.count() - 1 Step 1
        arrL.add(mte.EdgeLine(i))
        arrI.add(mte.GetTopologyVertices(i).I)
        arrJ.add(mte.GetTopologyVertices(i).J)
      Next

      L = arrL
      A = arrI
      B = arrJ
    end if
# ---------- end extract_edges ----------
radians = Radians(Degrees=Slider(30, range=1..90))
larger_than_4 = LargerThan(FirstNumber=edge_shared_face_angles.A, SecondNumber=radians)  # -> LargerThan, OrEqualTo
cull_pattern = CullPattern(List=extract_edges.L, CullPattern=larger_than_4.LargerThan)

ghpython_script = GhPythonScript(g=stream_gate.Target1)  # -> out, a, b
# ---------- ghpython_script: Python ----------
import Rhino.Geometry as rg
import itertools

def shortest_diagonal(geometry):
    # Get bounding box
    bbox = geometry.GetBoundingBox(True)
    
    # Get the corner points of the bounding box (8 corners)
    corners = bbox.GetCorners()
    
    # Generate all diagonals (pairs of opposite corners)
    diagonals = [
        (p1.DistanceTo(p2), (p1, p2)) for p1, p2 in itertools.combinations(corners, 2) if p1 != p2
    ]
    
    # Find the shortest diagonal
    min_diag = min(diagonals, key=lambda d: d[0])
    
    return min_diag[1], min_diag[0]  # Return the shortest diagonal points and length

# Grasshopper inputs
geometry = g  # Input geometry (should be referenced in Grasshopper)

if geometry:
    diag_points, diag_length = shortest_diagonal(geometry)
else:
    diag_points, diag_length = None, None

# Grasshopper outputs
a = diag_points  # The two points defining the shortest diagonal
b = diag_length  # The length of the shortest diagonal
# ---------- end ghpython_script ----------
division_4 = Division(A=ghpython_script.b, B=Slider(15, range=10..200))
smaller_than_3 = SmallerThan(FirstNumber=division_4, SecondNumber="0.3")  # -> SmallerThan, OrEqualTo
stream_filter = StreamFilter(Gate=smaller_than_3.SmallerThan, Stream0=division_4, Stream1="0.3")

# ----
# shortest diagonal of a box, if it's shorter than one, we'll use one as the size for the mesh
panel_2 = Panel("sharp edges")
triremesh = TriRemesh(
    Geometry=stream_gate.Target1,
    Sharp=Toggle(True),
    Features=cull_pattern,
    Length=stream_filter,
    Iterations=Slider(30, range=1..40))  # -> Triangulation, Dual, Creases
join_weld_meshes = JoinWeldMeshes(Meshes=triremesh.Triangulation)
mesh_6 = Mesh(join_weld_meshes)

panel_3 = Panel(" remesh if needed")
mesh_7 = Mesh(stream_gate.Target0)
# mesh to work with
mesh_8 = Mesh(flatten([mesh_7, mesh_6]))
mesh_edges = MeshEdges(Mesh=mesh_8)  # -> AllE, NakedE
mesh_9 = Mesh(<mesh referenced from the Rhino model>)
relay = Relay()  # disabled
relay_2 = Relay()  # disabled
mesh_10 = Mesh(<mesh referenced from the Rhino model>)  # disabled
triremesh_2 = TriRemesh(Geometry=mesh_10, Sharp=True, Iterations=25)  # -> Triangulation, Dual, Creases; disabled

# ----
# Eval srf
deconstruct_mesh_2 = DeconstructMesh(Mesh=triremesh_2.Triangulation)  # -> Vertices, flatten(Faces), Colours, Normals; disabled
face_normals = FaceNormals(Mesh=triremesh_2.Triangulation)  # -> Centers, Normals; disabled
angle = Angle(VectorA=face_normals.Normals, VectorB=relay)  # -> Angle, Reflex; disabled
panel_4 = Panel("0.5 * Pi")  # disabled

number_slider_3 = Slider(3, range=0..10)
panel_5 = Panel(" grote mesh")

equals = Equality(FirstNumber=angle.Angle, SecondNumber=panel_4)  # -> Equality, Inequality; disabled
cull = CullPattern(List=deconstruct_mesh_2.Faces, CullPattern=equals.Equality)  # disabled
# Split mesh - colors
construct_mesh = ConstructMesh(Vertices=deconstruct_mesh_2.Vertices, Faces=cull)  # disabled
colour_swatch = ColourSwatch(SwatchColor=RGB(44, 145, 55))  # disabled
mesh_colours = MeshColours(Mesh=construct_mesh, Colours=colour_swatch)  # disabled

smaller = SmallerThan(FirstNumber=angle.Angle, SecondNumber=panel_4)  # -> SmallerThan, OrEqualTo; disabled
cull_2 = CullPattern(List=deconstruct_mesh_2.Faces, CullPattern=smaller.SmallerThan)  # disabled
construct_mesh_2 = ConstructMesh(Vertices=deconstruct_mesh_2.Vertices, Faces=cull_2)  # disabled
colour_swatch_2 = ColourSwatch(SwatchColor=RGB(199, 190, 30))  # disabled
mesh_colours_2 = MeshColours(Mesh=construct_mesh_2, Colours=colour_swatch_2)  # disabled

larger = LargerThan(FirstNumber=angle.Angle, SecondNumber=panel_4)  # -> LargerThan, OrEqualTo; disabled
cull_3 = CullPattern(List=deconstruct_mesh_2.Faces, CullPattern=larger.LargerThan)  # disabled
construct_mesh_3 = ConstructMesh(Vertices=deconstruct_mesh_2.Vertices, Faces=cull_3)  # disabled
colour_swatch_3 = ColourSwatch(SwatchColor=RGB(63, 124, 143))  # disabled
mesh_colours_3 = MeshColours(Mesh=construct_mesh_3, Colours=colour_swatch_3)  # disabled

mesh_edges_2 = MeshEdges(Mesh=construct_mesh_2)  # -> NakedEdges, InteriorEdges, NonManifoldEdges; disabled
# hier splitline uit halen. Pas op voor neutrale oppervlakten!!!
mesh_edges_3 = MeshEdges(Mesh=construct_mesh_3)  # -> NakedEdges, InteriorEdges, NonManifoldEdges; disabled
curve = Curve(mesh_edges_2.NakedEdges)  # disabled
curve_2 = Curve(mesh_edges_3.NakedEdges)  # disabled
rebuild_mesh = RebuildMesh(
    Mesh=construct_mesh_3,
    RebuildNormals=False,
    CullUnused=True,
    UnifyNormals=False,
    FlipNormals=False,
    IdenticalCombine=False,
    WeldVertices=0)  # disabled
deconstruct_mesh_3 = DeconstructMesh(Mesh=rebuild_mesh)  # -> Vertices, Faces, Colours, Normals; disabled
occlusion = Occlusion(Samples=deconstruct_mesh_3.Vertices, Obstructions=triremesh_2.Triangulation, Rays=relay_2)  # -> Hits, Occlusion; disabled
dispatch = Dispatch(List=deconstruct_mesh_3.Vertices, DispatchPattern=occlusion.Hits)  # -> simplify(ListA), simplify(ListB); disabled
point = Point(dispatch.ListA)  # disabled
list_length_3 = ListLength(List=point)  # disabled
mesh_closest_point = MeshClosestPoint(Point=point, Mesh=construct_mesh)  # -> Point, Index, Parameter; disabled
construct_mesh_4 = ConstructMesh(Vertices=deconstruct_mesh_3.Vertices, Faces=graft(deconstruct_mesh_3.Faces))  # -> simplify(flatten(Mesh)); disabled
number = Number(list_length_3)  # disabled
distance = Distance(PointA=mesh_closest_point.Point, PointB=point)  # disabled
panel_6 = Panel(" occluded mesh")
panel_7 = Panel("0.01")  # disabled
panel_8 = Panel("1")  # disabled
smaller_than_4 = SmallerThan(FirstNumber=distance, SecondNumber=panel_7)  # -> SmallerThan, OrEqualTo; disabled
dispatch_2 = Dispatch(List=point, DispatchPattern=smaller_than_4.SmallerThan)  # -> ListA, ListB; disabled
galapagos = Galapagos()
point_2 = Point(flatten(dispatch_2.ListB))  # disabled
mesh_closest_point_2 = MeshClosestPoint(Point=point_2, Mesh=construct_mesh_4)  # -> Point, Index, Parameter; disabled
distance_2 = Distance(PointA=graft(mesh_closest_point_2.Point), PointB=point_2)  # disabled
panel_9 = Panel("0")  # disabled
equality = Equality(FirstNumber=distance_2, SecondNumber=panel_9)  # -> Equality, Inequality; disabled
dispatch_3 = Dispatch(List=distance_2, DispatchPattern=equality.Equality)  # -> simplify(ListA), simplify(ListB); disabled
panel_10 = Panel("1")  # disabled
panel_11 = Panel("1")  # disabled
insert_items = InsertItems(List=dispatch_3.ListA, Item=panel_11, Indices=panel_10, Wrap=False)  # disabled
panel_12 = Panel("1")  # disabled
replace_nulls = ReplaceNulls(Items=insert_items, Replacements=panel_12)  # -> Items, Count; disabled
list_item = ListItem(List=replace_nulls.Items, Index=0, Wrap=True)  # -> flatten(Item); disabled
panel_13 = Panel(list_item)  # disabled
construct_mesh_5 = ConstructMesh(Vertices=[Point(0, 0, 0), Point(10, 0, 0), Point(10, 10, 0), Point(0, 10, 0)], Faces=graft({A=0, B=1, C=2, D=3}))  # -> simplify(flatten(Mesh)); disabled
panel_14 = Panel("0")  # disabled
panel_15 = Panel("1")  # disabled
panel_16 = Panel("1")  # disabled
panel_17 = Panel("1")  # disabled

# ----
# Prevents plane from being invalid
number_slider_4 = Slider(0, range=0..1)
number_slider_5 = Slider(0, range=0..1)
number_slider_6 = Slider(0.41, range=0..1)
# Major pull direction
ma = MassAddition(Input=[number_slider_4, number_slider_5, number_slider_6])  # -> Result, PartialResults
equals_2 = Equality(FirstNumber=ma.Result, SecondNumber="0")  # -> Equality, Inequality
multiplication = Multiplication(A="0.001", B=equals_2.Equality)
addition = Addition(A=multiplication, B=number_slider_4)

addition_2 = Addition(A=multiplication, B=number_slider_5)
addition_3 = Addition(A=multiplication, B=number_slider_6)

vec = VectorXYZ(XComponent=addition, YComponent=addition_2, ZComponent=addition_3)  # -> unitize(Vector), Length
pl = PlaneNormal(Origin=Point(0, 0, 0), ZAxis=vec.Vector)

# ----
# Eval srf
deconstruct_mesh_4 = DeconstructMesh(Mesh=mesh_9)  # -> Vertices, flatten(Faces), Colours, Normals
face_normals_2 = FaceNormals(Mesh=mesh_9)  # -> Centers, Normals
angle_2 = Angle(VectorA=face_normals_2.Normals, VectorB=vec.Vector)  # -> Angle, Reflex

line_sdl = LineSDL(Start=pl, Direction=vec.Vector, Length=Slider(6, range=0..100))

equals_3 = Equality(FirstNumber=angle_2.Angle, SecondNumber="0.5 * Pi")  # -> Equality, Inequality
cull_4 = CullPattern(List=deconstruct_mesh_4.Faces, CullPattern=equals_3.Equality)
# Split mesh - colors
construct_mesh_6 = ConstructMesh(Vertices=deconstruct_mesh_4.Vertices, Faces=cull_4)
mesh_colours_4 = MeshColours(Mesh=construct_mesh_6, Colours=ColourSwatch(SwatchColor=RGB(44, 145, 55)))

smaller_2 = SmallerThan(FirstNumber=angle_2.Angle, SecondNumber="0.5 * Pi")  # -> SmallerThan, OrEqualTo
cull_5 = CullPattern(List=deconstruct_mesh_4.Faces, CullPattern=smaller_2.SmallerThan)
construct_mesh_7 = ConstructMesh(Vertices=deconstruct_mesh_4.Vertices, Faces=cull_5)
mesh_colours_5 = MeshColours(Mesh=construct_mesh_7, Colours=ColourSwatch(SwatchColor=RGB(199, 190, 30)))

larger_2 = LargerThan(FirstNumber=angle_2.Angle, SecondNumber="0.5 * Pi")  # -> LargerThan, OrEqualTo
cull_6 = CullPattern(List=deconstruct_mesh_4.Faces, CullPattern=larger_2.LargerThan)
construct_mesh_8 = ConstructMesh(Vertices=deconstruct_mesh_4.Vertices, Faces=cull_6)
mesh_colours_6 = MeshColours(Mesh=construct_mesh_8, Colours=ColourSwatch(SwatchColor=RGB(63, 124, 143)))

disjoint_mesh = DisjointMesh(Mesh=mesh_colours_5)
disjoint_mesh_2 = DisjointMesh(Mesh=mesh_colours_4)
disjoint_mesh_3 = DisjointMesh(Mesh=mesh_colours_6)
deconstruct_mesh_5 = DeconstructMesh(Mesh=disjoint_mesh)  # -> Vertices, simplify(Faces), Colours, Normals
deconstruct_mesh_6 = DeconstructMesh(Mesh=disjoint_mesh_2)  # -> Vertices, simplify(Faces), Colours, Normals
deconstruct_mesh_7 = DeconstructMesh(Mesh=disjoint_mesh_3)  # -> Vertices, simplify(Faces), Colours, Normals
list_length_4 = ListLength(List=deconstruct_mesh_6.Faces)
list_length_5 = ListLength(List=deconstruct_mesh_7.Faces)
list_length_6 = ListLength(List=deconstruct_mesh_5.Faces)
smaller_than_5 = SmallerThan(FirstNumber=flatten(list_length_4), SecondNumber=number_slider_3)  # -> SmallerThan, OrEqualTo
smaller_than_6 = SmallerThan(FirstNumber=flatten(list_length_5), SecondNumber=number_slider_3)  # -> SmallerThan, OrEqualTo
smaller_than_7 = SmallerThan(FirstNumber=flatten(list_length_6), SecondNumber=number_slider_3)  # -> SmallerThan, OrEqualTo
dispatch_4 = Dispatch(List=disjoint_mesh_2, DispatchPattern=smaller_than_5.SmallerThan)  # -> ListA, ListB
dispatch_5 = Dispatch(List=disjoint_mesh_3, DispatchPattern=smaller_than_6.SmallerThan)  # -> ListA, ListB
dispatch_6 = Dispatch(List=disjoint_mesh, DispatchPattern=smaller_than_7.SmallerThan)  # -> ListA, ListB
join_weld_meshes_2 = JoinWeldMeshes(Meshes=dispatch_4.ListB)
join_weld_meshes_3 = JoinWeldMeshes(Meshes=dispatch_5.ListB)
join_weld_meshes_4 = JoinWeldMeshes(Meshes=dispatch_6.ListB)
panel_18 = Panel(dispatch_6.ListB)
panel_19 = Panel(dispatch_6.ListA)
mesh_edges_4 = MeshEdges(Mesh=join_weld_meshes_3)  # -> graft(NakedEdges), InteriorEdges, NonManifoldEdges
mesh_edges_5 = MeshEdges(Mesh=join_weld_meshes_2)  # -> graft(NakedEdges), InteriorEdges, NonManifoldEdges
mesh_edges_6 = MeshEdges(Mesh=dispatch_6.ListA)  # -> NakedEdges, InteriorEdges, NonManifoldEdges
mesh_edges_7 = MeshEdges(Mesh=join_weld_meshes_4)  # -> NakedEdges, InteriorEdges, NonManifoldEdges
mesh_mesh = MeshMesh(MeshA=[join_weld_meshes_2, join_weld_meshes_3], MeshB=dispatch_6.ListA)
curve_proximity = CurveProximity(CurveA=simplify(graft([mesh_edges_5.NakedEdges, mesh_edges_4.NakedEdges])), CurveB=flatten(mesh_edges_6.NakedEdges))  # -> PointA, PointB, Distance
length = Length(Curve=mesh_mesh)
smaller_than_8 = SmallerThan(FirstNumber=curve_proximity.Distance, SecondNumber="0.01")  # -> SmallerThan, OrEqualTo
panel_20 = Panel(smaller_than_8.SmallerThan)
mass_addition_3 = MassAddition(Input=smaller_than_8.SmallerThan)  # -> Result, PartialResults
larger_than_5 = LargerThan(FirstNumber=mass_addition_3.Result, SecondNumber=1)  # -> LargerThan, OrEqualTo
create_set = CreateSet(List=larger_than_5.LargerThan)  # -> Set, Map
rebuild_mesh_2 = RebuildMesh(
    Mesh=mesh_colours_6,
    RebuildNormals=False,
    CullUnused=True,
    UnifyNormals=False,
    FlipNormals=False,
    IdenticalCombine=False,
    WeldVertices=0)
deconstruct_mesh_8 = DeconstructMesh(Mesh=rebuild_mesh_2)  # -> Vertices, Faces, Colours, Normals
occlusion_2 = Occlusion(Samples=deconstruct_mesh_8.Vertices, Obstructions=mesh_9, Rays=vec.Vector)  # -> Hits, Occlusion
dispatch_7 = Dispatch(List=deconstruct_mesh_8.Vertices, DispatchPattern=occlusion_2.Hits)  # -> simplify(ListA), simplify(ListB)

mesh_closest_point_3 = MeshClosestPoint(Point=dispatch_7.ListA, Mesh=construct_mesh_6)  # -> Point, Index, Parameter
distance_3 = Distance(PointA=mesh_closest_point_3.Point, PointB=dispatch_7.ListA)
# cull fake undercut regions
smaller_than_9 = SmallerThan(FirstNumber=distance_3, SecondNumber="0.01")  # -> SmallerThan, OrEqualTo
dispatch_8 = Dispatch(List=dispatch_7.ListA, DispatchPattern=smaller_than_9.SmallerThan)  # -> ListA, ListB
point_3 = Point(flatten(dispatch_8.ListB))

mesh_edges_8 = MeshEdges(Mesh=rebuild_mesh_2)  # -> AllE, NakedE; disabled
length_2 = Length(Curve=flatten(mesh_edges_8.AllE))  # disabled

construct_mesh_9 = ConstructMesh(Vertices=deconstruct_mesh_8.Vertices, Faces=graft(deconstruct_mesh_8.Faces))  # -> simplify(Mesh)
mesh_closest_point_4 = MeshClosestPoint(Point=point_3, Mesh=graft(construct_mesh_9))  # -> Point, Index, Parameter
distance_4 = Distance(PointA=point_3, PointB=mesh_closest_point_4.Point)
sort_list = SortList(Keys=distance_4)  # -> Keys, ValuesValuesA
list_item_2 = ListItem(List=sort_list.Keys, Index=0, Wrap=True)
smaller_than_10 = SmallerThan(FirstNumber=list_item_2, SecondNumber="0.01")  # -> simplify(SmallerThan), OrEqualTo
cull_pattern_2 = CullPattern(List=construct_mesh_9, CullPattern=smaller_than_10.SmallerThan)  # -> flatten(List)
join_weld_meshes_5 = JoinWeldMeshes(Meshes=cull_pattern_2)

average = Average(Input=length_2)  # disabled
multiplication_2 = Multiplication(A=average, B=1.5)  # disabled
point_groups = PointGroups(Points=point_3, Distance=multiplication_2)  # -> simplify(Groups), Indices; disabled
list_length_7 = ListLength(List=point_groups.Groups)  # disabled
larger_than_6 = LargerThan(FirstNumber=list_length_7, SecondNumber=panel_8)  # -> LargerThan, OrEqualTo; disabled
cull_pattern_3 = CullPattern(List=point_groups.Groups, CullPattern=larger_than_6.LargerThan)  # disabled
join_weld_meshes_6 = JoinWeldMeshes(Meshes=flatten([join_weld_meshes_5, construct_mesh_7]))
disjoint_mesh_4 = DisjointMesh(Mesh=join_weld_meshes_6)
list_item_3 = ListItem(List=disjoint_mesh_4, Index=Slider(0, range=0..1), Wrap=True)
mesh_closest_point_5 = MeshClosestPoint(Point=flatten(dispatch_8.ListB), Mesh=construct_mesh_5)  # -> Point, Index, Parameter; disabled
distance_5 = Distance(PointA=graft(mesh_closest_point_5.Point), PointB=flatten(point_3))  # disabled
equality_2 = Equality(FirstNumber=distance_5, SecondNumber=panel_14)  # -> Equality, Inequality; disabled
dispatch_9 = Dispatch(List=distance_5, DispatchPattern=equality_2.Equality)  # -> simplify(ListA), simplify(ListB); disabled
insert_items_2 = InsertItems(List=dispatch_9.ListA, Item=panel_16, Indices=panel_15, Wrap=False)  # disabled
replace_nulls_2 = ReplaceNulls(Items=insert_items_2, Replacements=panel_17)  # -> Items, Count; disabled
list_item_4 = ListItem(List=replace_nulls_2.Items, Index=0, Wrap=True)  # -> flatten(Item); disabled
panel_21 = Panel(list_item_4)  # disabled
