# Grasshopper definition Demould_V_0.01.gh (Grasshopper 1.0.7)
# plug-ins: Nautilus, LunchBox, VoxelTools, Pufferfish, DendroGH, NGon, Python

# ----
# Remesh organic
parameters = QuadRemeshParameters(
    TargetQuadCount=Slider(500, range=0..10000),
    UseAdaptiveQuads=Toggle(True),
    AdaptiveQuadSize=Slider(29, range=0..100),
    DetectHardEdges=True,
    PreserveMeshArrayHardEdges=Slider(1, range=0..2),
    SymmetryAxis=0,
    GuideCurveInfluence=Slider(0, range=0..2),
    TargetEdgeLength=0)  # disabled
mesh = Mesh()
# Slowest part of the code
remesh = QuadRemesh(MeshOrBrep=mesh, QuadRemeshParameters=parameters)
joinweldmesh = JoinWeldMeshes(Meshes=remesh)

parameters_2 = QuadRemeshParameters(
    TargetQuadCount=Slider(500, range=0..10000),
    UseAdaptiveQuads=True,
    AdaptiveQuadSize=50,
    DetectHardEdges=True,
    PreserveMeshArrayHardEdges=0,
    SymmetryAxis=0,
    GuideCurveInfluence=0,
    TargetEdgeLength=0)
brep = Brep(<brep referenced from the Rhino model>)
mesh_2 = MeshBrep(
    Brep=brep,
    Settings={GridMaxCount=0, GridMinCount=16, JaggedSeams=False, MaxEdgeLength=0, MinEdgeLength=0.0001, MinTolerance=0, Refine=True, RefineAngle=0, RelativeTolerance=0.65, SimplePlanes=True, Tolerance=0})
mesh_3 = Mesh(mesh_2)
remesh_2 = QuadRemesh(MeshOrBrep=mesh_3, QuadRemeshParameters=parameters_2)
bbox = BoundingBox(Content=mesh_3, Plane=PlaneXY(0, 0, 0))  # -> Box, Box_2
deconstruct_mesh = DeconstructMesh(Mesh=remesh_2)  # -> Vertices, Faces, Colours, Normals
number_slider = Slider(3, range=0..5)
isosurface = IsoSurface(
    Box={Plane=PlaneXY(0, 0, 0), X=Domain(-1, 1), Y=Domain(-1, 1), Z=Domain(-1, 1)},
    XResolution=2,
    YResolution=2,
    ZResolution=2,
    IsoValue=0.15,
    MergeVertices=False)
voxel_mesh = VoxelMesh(
    Points=deconstruct_mesh.Vertices,
    Plane=PlaneXY(0, 0, 0),
    SizeX=number_slider,
    SizeY=number_slider,
    SizeZ=number_slider,
    Triangulate=False)
number_slider_2 = Slider(1, range=0.4..1)  # disabled
weldmesh = WeldTheVerticesOfAMesh(Mesh=remesh_2, Tolerance=0.01)  # disabled
voxcreate = CreateVoxelGrid(BoundingBox=bbox.Box, SizeX=number_slider_2, SizeY=number_slider_2, SizeZ=number_slider_2)  # disabled
voxgeo = VoxelateGeometry(Geometry=weldmesh, VoxelGrid=voxcreate, Distance=0)  # disabled
panel = Panel("-1.5")  # disabled
multiplication = Multiplication(A=number_slider_2, B=panel)  # disabled
vglist = VoxelGridToList(Grids=voxgeo)  # -> Bool, Pts; disabled
panel_2 = Panel(voxgeo)  # disabled
mshoffset = MeshOffset(Mesh=weldmesh, OffsetDistance=multiplication, SolidToggle=False, OffsetBothSidesToggle=False)  # disabled
cull = CullPattern(List=vglist.Pts, CullPattern=vglist.Bool)  # disabled
toggle = BooleanToggle(True)  # disabled
voxmeshhull = VoxelGridToMeshHull(VoxelGrid=voxgeo, FakeShadow=False)  # -> Mesh, X, X_2, Y, Y_2, Z, Z_2; disabled
minc = MeshInclusion(Mesh=mshoffset, Point=cull, Strict=toggle)  # disabled
invbool = InvertBoolean(Boolean=minc)  # -> Inverted, Number; disabled
occlusion = Occlusion()  # -> Hits, Occlusion; disabled
cull_2 = CullPattern(List=cull, CullPattern=invbool.Inverted)  # disabled
division = Division(A=number_slider_2, B=2)  # disabled
mesh_ray = MeshRay()  # -> Point, Hit; disabled
line_sdl = LineSDL(Direction=Vector(0, 0, 1), Length=1)  # disabled
create_settings = CreateSettings(VoxelSize=1, Bandwidth=1, Isovalue=0, Adaptivity=0.1)  # disabled
box = CenterBox(Base=cull_2, X=division, Y=division, Z=division)  # disabled
volume_to_mesh = VolumeToMesh(VolumeSettings=create_settings)  # disabled
deconstruct_box = DeconstructBox(Box=box)  # -> Plane, X, Y, Z; disabled

# ----
# Prevents plane from being invalid
number_slider_3 = Slider(0, range=0..1)
number_slider_4 = Slider(0.02, range=0..1)
number_slider_5 = Slider(0.64, range=0..1)
# Major pull direction
ma = MassAddition(Input=[number_slider_3, number_slider_4, number_slider_5])  # -> Result, PartialResults
equals = Equality(FirstNumber=ma.Result, SecondNumber="0")  # -> Equality, Inequality
multiplication_2 = Multiplication(A="0.001", B=equals.Equality)
addition = Addition(A=multiplication_2, B=number_slider_3)

addition_2 = Addition(A=multiplication_2, B=number_slider_4)
addition_3 = Addition(A=multiplication_2, B=number_slider_5)

vec = VectorXYZ(XComponent=addition, YComponent=addition_2, ZComponent=addition_3)  # -> unitize(Vector), Length
pl = PlaneNormal(Origin=Point(0, 0, 0), ZAxis=vec.Vector)

line_sdl_2 = LineSDL(Start=pl, Direction=vec.Vector, Length=Slider(6, range=0..100))
