# Grasshopper definition Shape_designs.gh (Grasshopper 1.0.8)
# plug-ins: GhPolyhedra, LunchBox, NGon_RH8

number_slider = Slider(0, range=0..1)
polyhedra_categories = PolyhedraCategories()
polyhedra_names = PolyhedraNames(Category=polyhedra_categories)
platonic_dodecahedron = PlatonicDodecahedron(Plane=PlaneXY(0, 0, 0), Radius=Slider(60, range=0..100))
list_item = ListItem(List=flatten(polyhedra_names), Index=Slider(69, range=0..100), Wrap=True)
construct_point = ConstructPoint(XCoordinate=0, YCoordinate=0, ZCoordinate=0)
polyhedron = Polyhedron(Name=list_item, Plane=PlaneXY(0, 0, 0), Scale=Slider(60, range=0..100))  # -> Curves, Meshes, Solid
unweld_mesh = UnweldMesh(Mesh=polyhedron.Meshes, Angle=1.570796327)
area = Area(Geometry=unweld_mesh)  # -> Area, Centroid
line = Line(StartPoint=construct_point, EndPoint=area.Centroid)
multipipe = MultiPipe(
    Curves=line,
    NodeSize=Slider(12, range=0..20),
    EndOffset=1,
    StrutSize=1,
    Segment=0,
    KinkAngle=0.6,
    CubeFit=Slider(1, range=0..1),
    Caps="2")
quad_remesh_parameters = QuadRemeshParameters(
    TargetQuadCount=1000,
    UseAdaptiveQuads=True,
    AdaptiveQuadSize=50,
    DetectHardEdges=True,
    PreserveMeshArrayHardEdges=0,
    SymmetryAxis=0,
    GuideCurveInfluence=0,
    TargetEdgeLength=0)
brep = Brep(<brep referenced from the Rhino model>)
mesh_brep = MeshBrep(
    Brep=brep,
    Settings={GridMaxCount=0, GridMinCount=16, JaggedSeams=False, MaxEdgeLength=0, MinEdgeLength=0.0001, MinTolerance=0, Refine=True, RefineAngle=0, RelativeTolerance=0.65, SimplePlanes=True, Tolerance=0})
quad_remesh = QuadRemesh(MeshOrBrep=mesh_brep, QuadRemeshParameters=quad_remesh_parameters)
mesh_edges = MeshEdges(Mesh=quad_remesh)  # -> AllE, NakedE
