# Grasshopper definition Shape_designs_2.gh (Grasshopper 1.0.8)
# plug-ins: GhPolyhedra, LunchBox, NGon_RH8

polyhedra_categories = PolyhedraCategories()
polyhedra_names = PolyhedraNames(Category=polyhedra_categories)
platonic_tetrahedron = PlatonicTetrahedron(Plane=PlaneXY(0, 0, 0), Radius=Slider(120, range=0..120), Truncation=Slider(0, range=0..1))
list_item = ListItem(List=flatten(polyhedra_names), Index=Slider(60, range=0..100), Wrap=True)
deconstruct_brep = DeconstructBrep(Brep=platonic_tetrahedron)  # -> Faces, Edges, Vertices
construct_point = ConstructPoint(XCoordinate=0, YCoordinate=0, ZCoordinate=0)
area = Area(Geometry=deconstruct_brep.Faces)  # -> Area, Centroid
polyhedron = Polyhedron(Name=list_item, Plane=PlaneXY(0, 0, 0), Scale=Slider(60, range=0..100))  # -> Curves, Meshes, Solid
number_slider = Slider(18, range=0..100)
unweld_mesh = UnweldMesh(Mesh=polyhedron.Meshes, Angle=1.570796327)
line = Line(StartPoint=construct_point, EndPoint=area.Centroid)
split_list = SplitList(List=area.Centroid, Index="1")  # -> ListA, ListB
vector_xyz = VectorXYZ(XComponent=number_slider, YComponent=number_slider, ZComponent=0)  # -> Vector, Length
multipipe = MultiPipe(
    Curves=line,
    NodeSize=Slider(12, range=0..20),
    EndOffset=1,
    StrutSize=1,
    Segment=0,
    KinkAngle=0.6,
    CubeFit=Slider(1, range=0..1),
    Caps="2")
move = Move(Geometry=split_list.ListA, Motion=vector_xyz.Vector)  # -> Geometry, Transform
quad_remesh_parameters = QuadRemeshParameters(
    TargetQuadCount=Slider(3000, range=0..10000),
    UseAdaptiveQuads=True,
    AdaptiveQuadSize=50,
    DetectHardEdges=True,
    PreserveMeshArrayHardEdges=0,
    SymmetryAxis=0,
    GuideCurveInfluence=0,
    TargetEdgeLength=0)
merge = Merge(Data1=move.Geometry, Data2=split_list.ListB)
brep = Brep(multipipe)
mesh_brep = MeshBrep(
    Brep=brep,
    Settings={GridMaxCount=0, GridMinCount=16, JaggedSeams=False, MaxEdgeLength=0, MinEdgeLength=0.0001, MinTolerance=0, Refine=True, RefineAngle=0, RelativeTolerance=0.65, SimplePlanes=True, Tolerance=0})
quad_remesh = QuadRemesh(MeshOrBrep=mesh_brep, QuadRemeshParameters=quad_remesh_parameters)
mesh_edges = MeshEdges(Mesh=quad_remesh)  # -> AllE, NakedE
