# Grasshopper definition Tetrapod_0.08.gh (Grasshopper 1.0.8)
# plug-ins: Heteroptera, MeshEdit Components, Pufferfish, Python, Opossum2_0_Proto_A, Nautilus, NGon_RH8

value_list = ValueList({"Two": 2, "Three": 3, "Four": 4}, selected="Four")
panel = Panel(" est. mould parts")
number_slider = Slider(4, range=-180..180)
number_slider_2 = Slider(-138, range=-180..180)
number_slider_3 = Slider(-12, range=-180..180)
opossum = Opossum(
    OpossumData_NumberOfObjectives=1,
    OpossumData_OptimizationType=0,
    OpossumData_ResultSerializationStatus=1,
    OpossumData_ObjectiveValue=[66.79994319, 40.5323962, 45.74398301, 43.40717516, 65.08788196, 78.04923936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],
    OpossumData_ParameterList=["166.000000,-166.000000,-75.000000", "-63.000000,126.000000,142.000000", "0.000000,0.000000,0.000000", "-179.000000,180.000000,-179.000000", "-178.000000,-178.000000,169.000000", "179.000000,180.000000,59.000000"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],
    OpossumData_objective=data_5,
    OpossumData_variable=[number_slider, number_slider_2, number_slider_3])
dom = ConstructDomain(DomainStart="-1", DomainEnd="1")

# ----
# Prevents plane from being invalid
panel_2 = Panel("180")
dom_2 = ConstructDomain(DomainStart="-180", DomainEnd=panel_2)
remap = RemapNumbers(Value=number_slider_2, Source=dom_2, Target=dom)  # -> Mapped, Clipped
remap_2 = RemapNumbers(Value=number_slider_3, Source=dom_2, Target=dom)  # -> Mapped, Clipped
remap_3 = RemapNumbers(Value=number_slider, Source=dom_2, Target=dom)  # -> Mapped, Clipped
# Major pull direction
ma = MassAddition(Input=[remap_3.Mapped, remap.Mapped, remap_2.Mapped])  # -> Result, PartialResults
equals = Equality(FirstNumber=ma.Result, SecondNumber="0")  # -> Equality, Inequality
multiplication = Multiplication(A="0.001", B=equals.Equality)
addition = Addition(A=multiplication, B=remap_3.Mapped)
addition_2 = Addition(A=multiplication, B=remap.Mapped)
addition_3 = Addition(A=multiplication, B=remap_2.Mapped)
vec = VectorXYZ(XComponent=addition, YComponent=addition_2, ZComponent=addition_3)  # -> unitize(Vector), Length
pl = PlaneNormal(Origin=Point(0, 0, 0), ZAxis=vec.Vector)
line_sdl = LineSDL(Start=pl, Direction=vec.Vector, Length=Slider(6, range=0..100))

# ----
# input mesh - should be looped untill undercut region is 0
mesh = Mesh(<mesh referenced from the Rhino model>)
mesh_edges = MeshEdges(Mesh=mesh)  # -> NakedEdges, InteriorEdges, NonManifoldEdges

# ----
# Eval srf
deconstruct_mesh = DeconstructMesh(Mesh=mesh)  # -> Vertices, flatten(Faces), Colours, Normals
face_normals = FaceNormals(Mesh=mesh)  # -> Centers, Normals
angle = Angle(VectorA=face_normals.Normals, VectorB=vec.Vector)  # -> Angle, Reflex

equals_2 = Equality(FirstNumber=angle.Angle, SecondNumber="0.5 * Pi")  # -> Equality, Inequality
cull = CullPattern(List=deconstruct_mesh.Faces, CullPattern=equals_2.Equality)
# Split mesh - colors
construct_mesh = ConstructMesh(Vertices=deconstruct_mesh.Vertices, Faces=cull)
mesh_colours = MeshColours(Mesh=construct_mesh, Colours=ColourSwatch(SwatchColor=RGB(44, 145, 55)))

smaller = SmallerThan(FirstNumber=angle.Angle, SecondNumber="0.5 * Pi")  # -> SmallerThan, OrEqualTo
cull_2 = CullPattern(List=deconstruct_mesh.Faces, CullPattern=smaller.SmallerThan)
construct_mesh_2 = ConstructMesh(Vertices=deconstruct_mesh.Vertices, Faces=cull_2)
mesh_colours_2 = MeshColours(Mesh=construct_mesh_2, Colours=ColourSwatch(SwatchColor=RGB(199, 190, 30)))

larger = LargerThan(FirstNumber=angle.Angle, SecondNumber="0.5 * Pi")  # -> LargerThan, OrEqualTo
cull_3 = CullPattern(List=deconstruct_mesh.Faces, CullPattern=larger.LargerThan)
construct_mesh_3 = ConstructMesh(Vertices=deconstruct_mesh.Vertices, Faces=cull_3)
mesh_colours_3 = MeshColours(Mesh=construct_mesh_3, Colours=ColourSwatch(SwatchColor=RGB(63, 124, 143)))

# ----
# check with which mesh each patch matches by looping
disjoint_mesh = DisjointMesh(Mesh=construct_mesh_3)  # disabled
disjoint_mesh_2 = DisjointMesh(Mesh=construct_mesh)  # disabled
disjoint_mesh_3 = DisjointMesh(Mesh=construct_mesh_2)  # disabled
number_slider_4 = Slider(3, range=0..10)  # disabled
deconstruct_mesh_2 = DeconstructMesh(Mesh=disjoint_mesh)  # -> Vertices, simplify(Faces), Colours, Normals; disabled
deconstruct_mesh_3 = DeconstructMesh(Mesh=disjoint_mesh_2)  # -> Vertices, simplify(Faces), Colours, Normals; disabled
deconstruct_mesh_4 = DeconstructMesh(Mesh=disjoint_mesh_3)  # -> Vertices, simplify(Faces), Colours, Normals; disabled
list_length = ListLength(List=deconstruct_mesh_2.Faces)  # disabled
list_length_2 = ListLength(List=deconstruct_mesh_3.Faces)  # disabled
list_length_3 = ListLength(List=deconstruct_mesh_4.Faces)  # disabled
smaller_than = SmallerThan(FirstNumber=flatten(list_length), SecondNumber=number_slider_4)  # -> SmallerThan, OrEqualTo; disabled
smaller_than_2 = SmallerThan(FirstNumber=flatten(list_length_2), SecondNumber=number_slider_4)  # -> SmallerThan, OrEqualTo; disabled
smaller_than_3 = SmallerThan(FirstNumber=flatten(list_length_3), SecondNumber=number_slider_4)  # -> SmallerThan, OrEqualTo; disabled
dispatch = Dispatch(List=disjoint_mesh, DispatchPattern=smaller_than.SmallerThan)  # -> ListA, ListB; disabled
dispatch_2 = Dispatch(List=disjoint_mesh_2, DispatchPattern=smaller_than_2.SmallerThan)  # -> ListA, ListB; disabled
dispatch_3 = Dispatch(List=disjoint_mesh_3, DispatchPattern=smaller_than_3.SmallerThan)  # -> ListA, ListB; disabled
join_weld_meshes = JoinWeldMeshes(Meshes=dispatch.ListB)  # -> simplify(Mesh); disabled
join_weld_meshes_2 = JoinWeldMeshes(Meshes=dispatch_2.ListB)  # -> simplify(Mesh); disabled
join_weld_meshes_3 = JoinWeldMeshes(Meshes=dispatch_3.ListB)  # -> simplify(Mesh); disabled
number_slider_5 = Slider(0.1, range=0..0.11)  # disabled
mesh_naked_edges = MeshNakedEdges(Mesh=join_weld_meshes_3)  # -> flatten(Edges), Indexes, IsNaked; disabled
mesh_naked_edges_2 = MeshNakedEdges(Mesh=join_weld_meshes)  # -> flatten(Edges), Indexes, IsNaked; disabled
mesh_naked_edges_3 = MeshNakedEdges(Mesh=join_weld_meshes_2)  # -> flatten(Edges), Indexes, IsNaked; disabled
mesh_edges_2 = MeshEdges(Mesh=dispatch.ListA)  # -> AllE, NakedE; disabled
mesh_edges_3 = MeshEdges(Mesh=dispatch_2.ListA)  # -> AllE, NakedE; disabled
mesh_edges_4 = MeshEdges(Mesh=dispatch_3.ListA)  # -> AllE, NakedE; disabled
list_length_4 = ListLength(List=mesh_edges_2.NakedE)  # disabled
list_length_5 = ListLength(List=mesh_edges_3.NakedE)  # disabled
list_length_6 = ListLength(List=mesh_edges_4.NakedE)  # disabled
equality = Equality(FirstNumber=list_length_4, SecondNumber=0)  # -> Equality, Inequality; disabled
boolean_toggle = BooleanToggle(False)  # disabled
equality_2 = Equality(FirstNumber=list_length_5, SecondNumber=0)  # -> Equality, Inequality; disabled
equality_3 = Equality(FirstNumber=list_length_6, SecondNumber=0)  # -> Equality, Inequality; disabled
line = Line([mesh_edges_3.NakedE, mesh_naked_edges.Edges])  # disabled
boolean_toggle_2 = BooleanToggle(False)  # disabled
boolean_toggle_3 = BooleanToggle(False)  # disabled
line_2 = Line([mesh_edges_3.NakedE, mesh_naked_edges_2.Edges])  # disabled
line_3 = Line([mesh_edges_2.NakedE, mesh_naked_edges_3.Edges])  # disabled
line_4 = Line([mesh_edges_2.NakedE, mesh_naked_edges.Edges])  # disabled
line_5 = Line([mesh_naked_edges_2.Edges, mesh_edges_4.NakedE])  # disabled
line_6 = Line([mesh_naked_edges_3.Edges, mesh_edges_4.NakedE])  # disabled
stream_filter = StreamFilter(Gate=equality.Equality, Stream0=line_3, Stream1=boolean_toggle)  # disabled
stream_filter_2 = StreamFilter(Gate=equality_2.Equality, Stream0=line_3, Stream1=boolean_toggle_2)  # disabled
stream_filter_3 = StreamFilter(Gate=equality_3.Equality, Stream0=line_6, Stream1=boolean_toggle_3)  # disabled
cluster = Cluster(tree=stream_filter_2, tree_2=stream_filter_2, tree_3=line)  # -> graft(data); disabled
cluster_2 = Cluster(tree=stream_filter, tree_2=stream_filter, tree_3=line_4)  # -> graft(data); disabled
mesh_2 = Mesh(graft(dispatch_2.ListA))  # disabled
cluster_3 = Cluster(tree=stream_filter_3, tree_2=stream_filter_3, tree_3=line_5)  # -> graft(data); disabled
mesh_3 = Mesh(graft(dispatch_3.ListA))  # disabled
mesh_4 = Mesh(graft(dispatch.ListA))  # disabled
deconstruct_path = DeconstructPath(Branch=cluster_2)  # disabled
deconstruct_path_2 = DeconstructPath(Branch=cluster)  # disabled
deconstruct_path_3 = DeconstructPath(Branch=cluster_3)  # disabled
mass_addition = MassAddition(Input=deconstruct_path)  # -> Result, PartialResults; disabled
mass_addition_2 = MassAddition(Input=deconstruct_path_2)  # -> Result, PartialResults; disabled
mass_addition_3 = MassAddition(Input=deconstruct_path_3)  # -> Result, PartialResults; disabled
panel_3 = Panel("0")  # disabled
panel_4 = Panel("0")  # disabled
panel_5 = Panel("0")  # disabled
equality_4 = Equality(FirstNumber=mass_addition.Result, SecondNumber=panel_3)  # -> flatten(Equality), Inequality; disabled
equality_5 = Equality(FirstNumber=mass_addition_2.Result, SecondNumber=panel_4)  # -> flatten(Equality), Inequality; disabled
equality_6 = Equality(FirstNumber=mass_addition_3.Result, SecondNumber=panel_5)  # -> flatten(Equality), Inequality; disabled
dispatch_4 = Dispatch(List=flatten(mesh_4), DispatchPattern=equality_4.Equality)  # -> ListA, ListB; disabled
panel_6 = Panel(equality_4.Equality)  # disabled
dispatch_5 = Dispatch(List=flatten(mesh_2), DispatchPattern=equality_5.Equality)  # -> ListA, ListB; disabled
panel_7 = Panel(equality_5.Equality)  # disabled
dispatch_6 = Dispatch(List=flatten(mesh_3), DispatchPattern=equality_6.Equality)  # -> ListA, ListB; disabled
panel_8 = Panel(equality_6.Equality)  # disabled
panel_9 = Panel("yellow")  # disabled
panel_10 = Panel("green")  # disabled
panel_11 = Panel("Blue")  # disabled
panel_14 = Panel("blue")  # disabled
join_weld_meshes_4 = JoinWeldMeshes(Meshes=flatten([join_weld_meshes_2, dispatch_4.ListA, dispatch_6.ListA]))  # disabled
join_weld_meshes_5 = JoinWeldMeshes(Meshes=flatten([join_weld_meshes_3, dispatch_4.ListB, dispatch_5.ListB]))  # disabled
join_weld_meshes_6 = JoinWeldMeshes(Meshes=flatten([join_weld_meshes, dispatch_5.ListA, dispatch_6.ListB]))  # disabled
panel_15 = Panel("Yellow")  # disabled

disjoint_mesh_4 = DisjointMesh(Mesh=construct_mesh)  # -> flatten(Meshes)
mesh_5 = Mesh(construct_mesh_3)
rebuild_mesh = RebuildMesh(
    Mesh=construct_mesh_3,
    RebuildNormals=False,
    CullUnused=True,
    UnifyNormals=False,
    FlipNormals=False,
    IdenticalCombine=False,
    WeldVertices=0)
mesh_mesh = MeshMesh(MeshA=graft(disjoint_mesh_4), MeshB=mesh_5)  # -> simplify(Intersections)
deconstruct_mesh_5 = DeconstructMesh(Mesh=rebuild_mesh)  # -> Vertices, Faces, Colours, Normals
list_length_7 = ListLength(List=mesh_mesh)
occlusion = Occlusion(Samples=deconstruct_mesh_5.Vertices, Obstructions=mesh, Rays=vec.Vector)  # -> Hits, Occlusion
larger_than = LargerThan(FirstNumber=list_length_7, SecondNumber=Slider(0, range=0..100))  # -> flatten(LargerThan), OrEqualTo
dispatch_7 = Dispatch(List=deconstruct_mesh_5.Vertices, DispatchPattern=occlusion.Hits)  # -> simplify(ListA), simplify(ListB)
dispatch_8 = Dispatch(List=disjoint_mesh_4, DispatchPattern=larger_than.LargerThan)  # -> flatten(ListA), ListB

mesh_closest_point = MeshClosestPoint(Point=dispatch_7.ListA, Mesh=construct_mesh)  # -> Point, Index, Parameter
distance = Distance(PointA=mesh_closest_point.Point, PointB=dispatch_7.ListA)
# cull fake undercut regions
smaller_than_4 = SmallerThan(FirstNumber=distance, SecondNumber="0.01")  # -> SmallerThan, OrEqualTo
dispatch_9 = Dispatch(List=dispatch_7.ListA, DispatchPattern=smaller_than_4.SmallerThan)  # -> ListA, ListB
point = Point(flatten(dispatch_9.ListB))

join_weld_meshes_7 = JoinWeldMeshes(Meshes=flatten([dispatch_8.ListA, mesh_5]))
lng = ListLength(List=flatten(dispatch_7.ListA))
data = Data(lng)
face_normals_2 = FaceNormals(Mesh=join_weld_meshes_7)  # -> Centers, Normals
deconstruct_mesh_6 = DeconstructMesh(Mesh=join_weld_meshes_7)  # -> Vertices, Faces, Colours, Normals
panel_18 = Panel("different method needed")
panel_19 = Panel("to minimize")
pt = Point(dispatch_7.ListA)
panel_20 = Panel("blue with green")
lng_2 = ListLength(List=point)
null = NullItem(Item=lng_2)  # -> NullFlags, InvalidFlags, Description
filter = StreamFilter(Gate=null.NullFlags, Stream0=point, Stream1=pt)
pt_2 = Point(filter)

construct_mesh_4 = ConstructMesh(Vertices=deconstruct_mesh_5.Vertices, Faces=graft(deconstruct_mesh_5.Faces))  # -> simplify(Mesh)
mesh_closest_point_2 = MeshClosestPoint(Point=pt_2, Mesh=graft(construct_mesh_4))  # -> Point, Index, Parameter
distance_2 = Distance(PointA=pt_2, PointB=mesh_closest_point_2.Point)
sort_list = SortList(Keys=distance_2)  # -> Keys, ValuesValuesA
list_item = ListItem(List=sort_list.Keys, Index=0, Wrap=True)
smaller_than_5 = SmallerThan(FirstNumber=list_item, SecondNumber="0.01")  # -> simplify(SmallerThan), OrEqualTo
cull_pattern = CullPattern(List=construct_mesh_4, CullPattern=smaller_than_5.SmallerThan)  # -> flatten(List)

panel_21 = Panel(" occluded mesh")
mesh_6 = Mesh(mesh_colours_2)
mesh_7 = Mesh()
panel_22 = Panel(cull_pattern)
mesh_join = MeshJoin(Meshes=cull_pattern)
weld_mesh = WeldMesh(Mesh=mesh_join, Angle=3.141592654)
face_normals_3 = FaceNormals(Mesh=weld_mesh)  # -> Centers, Normals
closest_points = ClosestPoints(Point=face_normals_3.Centers, Cloud=face_normals_2.Centers, Count="1")  # -> ClosestPoint, flatten(CPIndex), Distance
cull_index = CullIndex(List=deconstruct_mesh_6.Faces, Indices=closest_points.CPIndex, Wrap=True)
construct_mesh_5 = ConstructMesh(Vertices=deconstruct_mesh_6.Vertices, Faces=cull_index)
mesh_8 = Mesh(weld_mesh)
null_2 = NullItem(Item=mesh_8)  # -> NullFlags, InvalidFlags, Description
filter_2 = StreamFilter(Gate=null_2.NullFlags, Stream0=mesh_8, Stream1=mesh_7)
# yellow with occluded areas
join_weld_meshes_8 = JoinWeldMeshes(Meshes=flatten([filter_2, mesh_6]))
# yellow with the rest of the green
join_weld_meshes_9 = JoinWeldMeshes(Meshes=flatten([dispatch_8.ListB, join_weld_meshes_8]))
panel_23 = Panel(" total vertice count")
panel_24 = Panel("total mesh")
panel_25 = Panel("target mesh")
panel_26 = Panel("undercut")
data_2 = Data(deconstruct_mesh.Vertices)
mesh_9 = Mesh(construct_mesh_5)
mesh_10 = Mesh(mesh_9)
mesh_area = MeshArea(Mesh=mesh_10)  # -> Area, Centroid
mesh_11 = Mesh(mesh)
mesh_12 = Mesh(mesh_11)
mesh_area_2 = MeshArea(Mesh=mesh_12)  # -> Area, Centroid
boolean_toggle_4 = BooleanToggle(True)
panel_27 = Panel(" approx. symmetrical")
equality_7 = Equality(FirstNumber=value_list, SecondNumber=2)  # -> Equality, Inequality
mesh_colours_4 = MeshColours(Mesh=mesh_9, Colours=ColourSwatch(SwatchColor=RGB(150, 7, 163)))
division = Division(A=mesh_area_2.Area, B=value_list)
is_mesh_disjoint = IsMeshDisjoint(Mesh=mesh_9)  # -> Disjoint, Amount
pt_3 = Point(pt_2)
stream_freeze_gate = StreamFreezeGate(Data=boolean_toggle_4, PassingSwitch=equality_7.Inequality)
sort_list_2 = SortList(Keys=flatten([mesh_area.Area, division]), ValuesValuesA=flatten([mesh_area.Area, division]))  # -> Keys, simplify(graft(ValuesValuesA))
lng_3 = ListLength(List=pt_3)
data_3 = Data(lng_3)
null_3 = NullItem(Item=data_3)  # -> NullFlags, InvalidFlags, Description
equals_3 = Equality(FirstNumber=data_3, SecondNumber=0)  # -> Equality, Inequality
or = GateOr(A=null_3.NullFlags, B=equals_3.Equality)
stream_freeze_gate_2 = StreamFreezeGate(Data=or, PassingSwitch=equality_7.Equality)
stream_gate = StreamGate(Stream=flatten([mesh_area.Area, mesh_area_2.Area]), Gate=stream_freeze_gate)  # -> Target0, Target1
explode_tree = ExplodeTree(Data=sort_list_2.ValuesValuesA)  # -> Branch0, Branch1
division_2 = Division(A=explode_tree.Branch0, B=explode_tree.Branch1)
sort_list_3 = SortList(Keys=flatten(stream_gate.Target1), ValuesValuesA=flatten(stream_gate.Target1))  # -> Keys, simplify(graft(ValuesValuesA))
sort_list_4 = SortList(Keys=flatten(stream_gate.Target0), ValuesValuesA=flatten(stream_gate.Target0))  # -> Keys, simplify(graft(ValuesValuesA))
subtraction = Subtraction(A="1", B=division_2)
explode_tree_2 = ExplodeTree(Data=sort_list_4.ValuesValuesA)  # -> Branch0, Branch1
explode_tree_3 = ExplodeTree(Data=sort_list_3.ValuesValuesA)  # -> Branch0, Branch1
list_length_8 = ListLength(List=data_2)
division_3 = Division(A=explode_tree_2.Branch0, B=explode_tree_2.Branch1)
division_4 = Division(A="40", B="1200")
division_5 = Division(A=explode_tree_3.Branch1, B=value_list)
division_6 = Division(A=data_3, B=list_length_8)
panel_28 = Panel(" two part mould")
multiplication_2 = Multiplication(A=list_length_8, B=division_4)
stream_filter_4 = StreamFilter(Gate=stream_freeze_gate_2, Stream0=data_3, Stream1=subtraction)
data_4 = Data(flatten([explode_tree_3.Branch0, division_5]))
subtraction_2 = Subtraction(A="1", B=division_3)
stream_filter_5 = StreamFilter(Gate=boolean_toggle_4, Stream0=Slider(250, range=50..300), Stream1=multiplication_2)
subtraction_3 = Subtraction(A=value_list, B=2)
sort_list_5 = SortList(Keys=data_4, ValuesValuesA=data_4)  # -> Keys, simplify(graft(ValuesValuesA))
addition_4 = Addition(A=subtraction_2, B=stream_filter_5)
multiplication_3 = Multiplication(A=division_6, B=stream_filter_5)
explode_tree_4 = ExplodeTree(Data=sort_list_5.ValuesValuesA)  # -> Branch0, Branch1
division_7 = Division(A=explode_tree_4.Branch0, B=explode_tree_4.Branch1)
subtraction_4 = Subtraction(A="1", B=division_7)
multiplication_4 = Multiplication(A=Slider(45, range=1..70), B=subtraction_4)
multiplication_5 = Multiplication(A=is_mesh_disjoint.Amount, B=Slider(15, range=1..25))
addition_5 = Addition(A=multiplication_4, B=multiplication_3, C=multiplication_5)
stream_filter_6 = StreamFilter(Gate=subtraction_3, Stream0=stream_filter_4, Stream1=addition_4, Stream2=addition_5)
data_5 = Data(stream_filter_6)

# ==== cluster Cluster
tree = ClusterInput()
tree_statistics = TreeStatistics(Tree=tree)  # -> Paths, Length, Count
tree_2 = ClusterInput()
equality = Equality(FirstNumber=tree_2, SecondNumber="0")  # -> Equality, Inequality
invert_boolean = InvertBoolean(Boolean=equality.Equality)  # -> Inverted, Number
subtraction = Subtraction(A=tree_statistics.Count, B=1)
loop_start = LoopStart(Repeat=subtraction, Trigger=invert_boolean.Inverted)  # -> port, Counter, Data
tree_3 = ClusterInput()
tree_branch = TreeBranch(Tree=tree_2, Path=loop_start.Counter, MaintainPaths=True)
tree_branch_2 = TreeBranch(Tree=tree_3, Path=loop_start.Counter, MaintainPaths=True)
entwine = Entwine(Branch00=tree_branch, Branch01=tree_branch_2, FlattenInputs=True)
clean_duplicate_lines = CleanDuplicateLines(Lines=entwine, Tolerance=0.01)  # -> Lines, Indices, Status
invert_boolean_2 = InvertBoolean(Boolean=clean_duplicate_lines.Status)  # -> Inverted, Number
cull_pattern = CullPattern(List=entwine, CullPattern=invert_boolean_2.Inverted)
length = Length(Curve=cull_pattern)
mass_addition = MassAddition(Input=length)  # -> simplify(flatten(Result)), PartialResults
tree_statistics_2 = TreeStatistics(Tree=entwine)  # -> Paths, Length, Count
sort_list = SortList(Keys=mass_addition.Result, ValuesValuesA=tree_statistics_2.Paths)  # -> Keys, ValuesValuesA
list_item = ListItem(List=sort_list.ValuesValuesA, Index=Slider(1, range=0..1), Wrap=True)
loop_end = LoopEnd(port=loop_start.port, Exit=False, Data=list_item, TimeOutVal=0, pausedState=False, state="Constant & Record")
data = ClusterOutput(loop_end)
