# Grasshopper definition Tetrapod_0.19.gh (Grasshopper 1.0.8)
# plug-ins: Heteroptera, MeshEdit Components, Pufferfish, Python, Stripper, Opossum2_0_Proto_A, Nautilus, NGon_RH8

value_list = ValueList({"Two": 2, "Three": 3, "Four": 4}, selected="Two")
panel = Panel(" est. mould parts")
number_slider = Slider(-25, range=-180..180)
number_slider_2 = Slider(-32, range=-180..180)
number_slider_3 = Slider(116, range=-180..180)
# Major pull direction
opossum = Opossum(
    OpossumData_OptimizationType=0,
    OpossumData_ResultSerializationStatus=0,
    OpossumData_objective=data_5,
    OpossumData_variable=[number_slider, number_slider_2, number_slider_3])
dom = ConstructDomain(DomainStart="-1", DomainEnd="1")
# input mesh - should be looped untill undercut region is 0
mesh = Mesh(<mesh referenced from the Rhino model>)
mesh_edges = MeshEdges(Mesh=mesh)  # -> NakedEdges, InteriorEdges, NonManifoldEdges
python_3_script = Python3Script(M=mesh, Threshold=Slider(60, range=0..100))  # -> out, SharpEdges; inputs M: Mesh, Threshold: Double
# ---------- python_3_script: Python ----------
import Rhino.Geometry as rg
import math

sharp_edges = []

angle_threshold = math.radians(Threshold)

M.RebuildNormals()
M.FaceNormals.ComputeFaceNormals()

topo = M.TopologyEdges
face_normals = M.FaceNormals
face_count = M.Faces.Count

for i in range(topo.Count):
    connected_faces = topo.GetConnectedFaces(i)
    if len(connected_faces) == 2:
        f1, f2 = connected_faces
        if f1 < face_count and f2 < face_count:
            n1 = rg.Vector3d(face_normals[f1])
            n2 = rg.Vector3d(face_normals[f2])
            angle = rg.Vector3d.VectorAngle(n1, n2)

            # Debug print
            print("Edge {}: {:.2f} degrees".format(i, math.degrees(angle)))

            if angle > angle_threshold:
                edge_line = topo.EdgeLine(i)
                sharp_edges.append(edge_line)

SharpEdges = sharp_edges
# ---------- end python_3_script ----------
radians = Radians(Degrees="3")
radians_2 = Radians(Degrees="3")
mesh_2 = Mesh(<mesh referenced from the Rhino model>)
panel_2 = Panel("different method needed")
panel_3 = Panel("to minimize")
panel_4 = Panel("blue with green")
panel_5 = Panel(" occluded mesh")
mesh_3 = Mesh()
mesh_4 = Mesh(<mesh referenced from the Rhino model>)
deconstruct_mesh = DeconstructMesh(Mesh=mesh_4)  # -> Vertices, Faces, Colours, Normals
boolean_toggle = BooleanToggle(True)
panel_6 = Panel(" total vertice count")
panel_7 = Panel("total mesh")
panel_8 = Panel("target mesh")
mesh_5 = Mesh(mesh_2)
panel_9 = Panel("undercut")
data = Data()
mesh_area = MeshArea(Mesh=mesh_5)  # -> Area, Centroid
mesh_6 = Mesh(mesh)
null = NullItem(Item=data)  # -> NullFlags, InvalidFlags, Description
equals = Equality(FirstNumber=data, SecondNumber=0)  # -> Equality, Inequality
boolean_toggle_2 = BooleanToggle(True)
panel_10 = Panel(" approx. symmetrical")
equality = Equality(FirstNumber=value_list, SecondNumber=2)  # -> Equality, Inequality
division = Division(A=mesh_area.Area, B=value_list)
or = GateOr(A=null.NullFlags, B=equals.Equality)
stream_freeze_gate = StreamFreezeGate(Data=boolean_toggle_2, PassingSwitch=equality.Inequality)
stream_freeze_gate_2 = StreamFreezeGate(Data=or, PassingSwitch=equality.Equality)
multiplication = Multiplication(A=data, B=10)
division_2 = Division(A="40", B="1200")
division_3 = Division(A="40", B="1200")
panel_11 = Panel(" two part mould")
subtraction = Subtraction(A=value_list, B=2)
curve = Curve(python_3_script.SharpEdges)
join_curves = JoinCurves(Curves=curve, Preserve=False)
mesh_7 = Mesh(mesh_2)
number_slider_4 = Slider(1.2, range=1..2)
bounding_box = BoundingBox(Content=mesh_7, Plane=PlaneXY(0, 0, 0))  # -> Box, Box_2
volume = Volume(Geometry=mesh_7)  # -> Volume, Centroid
subtraction_2 = Subtraction(A=number_slider_4, B=0.05)
scale = Scale(Geometry=bounding_box.Box, Center=volume.Centroid, Factor=number_slider_4)  # -> Geometry, Transform
scale_2 = Scale(Geometry=bounding_box.Box, Center=volume.Centroid, Factor=subtraction_2)  # -> Geometry, Transform
number_slider_5 = Slider(118, range=0..1000)
boolean_toggle_3 = BooleanToggle(True)
boolean_toggle_4 = BooleanToggle(True)
loft_options = LoftOptions(Closed=False, Adjust=boolean_toggle_4, Rebuild=0, Refit=boolean_toggle_4, Type=Slider(5, range=0..5))
mesh_brep = MeshBrep(
    Brep=scale_2.Geometry,
    Settings={GridMaxCount=0, GridMinCount=16, JaggedSeams=False, MaxEdgeLength=0, MinEdgeLength=0.0001, MinTolerance=0, Refine=True, RefineAngle=0, RelativeTolerance=0.65, SimplePlanes=True, Tolerance=0})
mesh_difference = MeshDifference(MeshesA=mesh_brep, MeshesB=mesh_7)

# ----
# Prevents plane from being invalid
panel_12 = Panel("180")
dom_2 = ConstructDomain(DomainStart="-180", DomainEnd=panel_12)
remap = RemapNumbers(Value=number_slider_2, Source=dom_2, Target=dom)  # -> Mapped, Clipped
remap_2 = RemapNumbers(Value=number_slider_3, Source=dom_2, Target=dom)  # -> Mapped, Clipped
remap_3 = RemapNumbers(Value=number_slider, Source=dom_2, Target=dom)  # -> Mapped, Clipped
# Major pull direction
ma = MassAddition(Input=[remap_3.Mapped, remap.Mapped, remap_2.Mapped])  # -> Result, PartialResults
equals_2 = Equality(FirstNumber=ma.Result, SecondNumber="0")  # -> Equality, Inequality
multiplication_2 = Multiplication(A="0.001", B=equals_2.Equality)
addition = Addition(A=multiplication_2, B=remap_3.Mapped)
addition_2 = Addition(A=multiplication_2, B=remap.Mapped)
addition_3 = Addition(A=multiplication_2, B=remap_2.Mapped)
vec = VectorXYZ(XComponent=addition, YComponent=addition_2, ZComponent=addition_3)  # -> unitize(Vector), Length
# Eval srf
number_slider_6 = Slider(100, range=0..100)
pl = PlaneNormal(Origin=Point(0, 0, 0), ZAxis=vec.Vector)

reverse = Reverse(Vector=vec.Vector)

# ----
# Split mesh - colors
line_sdl = LineSDL(Start=pl, Direction=reverse, Length=number_slider_6)

# ----
# Eval srf
deconstruct_mesh_2 = DeconstructMesh(Mesh=mesh)  # -> Vertices, flatten(Faces), Colours, Normals
face_normals = FaceNormals(Mesh=mesh)  # -> Centers, Normals
angle = Angle(VectorA=face_normals.Normals, VectorB=vec.Vector)  # -> Angle, Reflex

addition_4 = Addition(A="0.5 * Pi", B=radians_2)
subtraction_3 = Subtraction(A="0.5 * Pi", B=radians)
construct_domain = ConstructDomain(DomainStart=subtraction_3, DomainEnd=addition_4)
includes = Includes(Value=angle.Angle, Domain=construct_domain)  # -> Includes, Deviation

equals_3 = Equality(FirstNumber=angle.Angle, SecondNumber="0.5 * Pi")  # -> Equality, Inequality
cull = CullPattern(List=deconstruct_mesh_2.Faces, CullPattern=includes.Includes)
# Split mesh - colors
construct_mesh = ConstructMesh(Vertices=deconstruct_mesh_2.Vertices, Faces=cull)
mesh_colours = MeshColours(Mesh=construct_mesh, Colours=ColourSwatch(SwatchColor=RGB(44, 145, 55)))

smaller = SmallerThan(FirstNumber=angle.Angle, SecondNumber=subtraction_3)  # -> SmallerThan, OrEqualTo
cull_2 = CullPattern(List=deconstruct_mesh_2.Faces, CullPattern=smaller.SmallerThan)
construct_mesh_2 = ConstructMesh(Vertices=deconstruct_mesh_2.Vertices, Faces=cull_2)
mesh_colours_2 = MeshColours(Mesh=construct_mesh_2, Colours=ColourSwatch(SwatchColor=RGB(199, 190, 30)))

larger = LargerThan(FirstNumber=angle.Angle, SecondNumber=addition_4)  # -> LargerThan, OrEqualTo
cull_3 = CullPattern(List=deconstruct_mesh_2.Faces, CullPattern=larger.LargerThan)
construct_mesh_3 = ConstructMesh(Vertices=deconstruct_mesh_2.Vertices, Faces=cull_3)
mesh_colours_3 = MeshColours(Mesh=construct_mesh_3, Colours=ColourSwatch(SwatchColor=RGB(63, 124, 143)))

disjoint_mesh = DisjointMesh(Mesh=construct_mesh)  # -> flatten(Meshes)
mesh_8 = Mesh(construct_mesh_3)
rebuild_mesh = RebuildMesh(
    Mesh=construct_mesh_3,
    RebuildNormals=False,
    CullUnused=True,
    UnifyNormals=False,
    FlipNormals=False,
    IdenticalCombine=False,
    WeldVertices=0)
mesh_mesh = MeshMesh(MeshA=graft(disjoint_mesh), MeshB=mesh_8)  # -> simplify(Intersections)
deconstruct_mesh_3 = DeconstructMesh(Mesh=rebuild_mesh)  # -> Vertices, Faces, Colours, Normals
list_length = ListLength(List=mesh_mesh)
occlusion = Occlusion(Samples=deconstruct_mesh_3.Vertices, Obstructions=mesh_2, Rays=vec.Vector)  # -> Hits, Occlusion
larger_than = LargerThan(FirstNumber=list_length, SecondNumber=Slider(0, range=0..100))  # -> flatten(LargerThan), OrEqualTo
dispatch = Dispatch(List=deconstruct_mesh_3.Vertices, DispatchPattern=occlusion.Hits)  # -> simplify(ListA), simplify(ListB)
dispatch_2 = Dispatch(List=disjoint_mesh, DispatchPattern=larger_than.LargerThan)  # -> flatten(ListA), ListB

mesh_closest_point = MeshClosestPoint(Point=dispatch.ListA, Mesh=construct_mesh)  # -> Point, Index, Parameter
distance = Distance(PointA=mesh_closest_point.Point, PointB=dispatch.ListA)
# cull fake undercut regions
smaller_than = SmallerThan(FirstNumber=distance, SecondNumber="0.01")  # -> SmallerThan, OrEqualTo
dispatch_3 = Dispatch(List=dispatch.ListA, DispatchPattern=smaller_than.SmallerThan)  # -> ListA, ListB
point = Point(flatten(dispatch_3.ListB))

join_weld_meshes = JoinWeldMeshes(Meshes=flatten([dispatch_2.ListA, mesh_8]))
face_normals_2 = FaceNormals(Mesh=join_weld_meshes)  # -> Centers, Normals
deconstruct_mesh_4 = DeconstructMesh(Mesh=join_weld_meshes)  # -> Vertices, Faces, Colours, Normals
pt = Point(dispatch.ListA)
lng = ListLength(List=point)
null_2 = NullItem(Item=lng)  # -> NullFlags, InvalidFlags, Description
filter = StreamFilter(Gate=null_2.NullFlags, Stream0=point, Stream1=pt)
pt_2 = Point(filter)

construct_mesh_4 = ConstructMesh(Vertices=deconstruct_mesh_3.Vertices, Faces=graft(deconstruct_mesh_3.Faces))  # -> simplify(Mesh)
mesh_closest_point_2 = MeshClosestPoint(Point=pt_2, Mesh=graft(construct_mesh_4))  # -> Point, Index, Parameter
distance_2 = Distance(PointA=pt_2, PointB=mesh_closest_point_2.Point)
sort_list = SortList(Keys=distance_2)  # -> Keys, ValuesValuesA
list_item = ListItem(List=sort_list.Keys, Index=0, Wrap=True)
smaller_than_2 = SmallerThan(FirstNumber=list_item, SecondNumber="0.01")  # -> simplify(SmallerThan), OrEqualTo
cull_pattern = CullPattern(List=construct_mesh_4, CullPattern=smaller_than_2.SmallerThan)  # -> flatten(List)

mesh_9 = Mesh(mesh_colours_2)
panel_13 = Panel(cull_pattern)
mesh_join = MeshJoin(Meshes=cull_pattern)
reverse_2 = Reverse(Vector=vec.Vector)
weld_mesh = WeldMesh(Mesh=mesh_join, Angle=3.141592654)
face_normals_3 = FaceNormals(Mesh=weld_mesh)  # -> Centers, Normals
closest_points = ClosestPoints(Point=face_normals_3.Centers, Cloud=face_normals_2.Centers, Count="1")  # -> ClosestPoint, flatten(CPIndex), Distance
cull_index = CullIndex(List=deconstruct_mesh_4.Faces, Indices=closest_points.CPIndex, Wrap=True)
construct_mesh_5 = ConstructMesh(Vertices=deconstruct_mesh_4.Vertices, Faces=cull_index)
mesh_10 = Mesh(weld_mesh)
null_3 = NullItem(Item=mesh_10)  # -> NullFlags, InvalidFlags, Description
filter_2 = StreamFilter(Gate=null_3.NullFlags, Stream0=mesh_10, Stream1=mesh_3)
# yellow with occluded areas
join_weld_meshes_2 = JoinWeldMeshes(Meshes=flatten([filter_2, mesh_9]))
occlusion_2 = Occlusion(Samples=deconstruct_mesh.Vertices, Obstructions=mesh_4, Rays=reverse_2)  # -> Hits, Occlusion
# yellow with the rest of the green
join_weld_meshes_3 = JoinWeldMeshes(Meshes=flatten([dispatch_2.ListB, join_weld_meshes_2]))
dispatch_4 = Dispatch(List=deconstruct_mesh_3.Vertices, DispatchPattern=occlusion_2.Hits)  # -> simplify(ListA), simplify(ListB)
mesh_closest_point_3 = MeshClosestPoint(Point=dispatch_4.ListA, Mesh=construct_mesh)  # -> Point, Index, Parameter
reverse_3 = Reverse(Vector=reverse_2)
pl_2 = PlaneNormal(Origin=Point(0, 0, 0), ZAxis=vec.Vector)
line_sdl_2 = LineSDL(Start=pl_2, Direction=reverse_3, Length=Slider(100, range=0..100))
distance_3 = Distance(PointA=mesh_closest_point_3.Point, PointB=dispatch_4.ListA)
smaller_than_3 = SmallerThan(FirstNumber=distance_3, SecondNumber="0.01")  # -> SmallerThan, OrEqualTo
dispatch_5 = Dispatch(List=dispatch_4.ListA, DispatchPattern=smaller_than_3.SmallerThan)  # -> ListA, ListB
point_2 = Point(flatten(dispatch_5.ListA))
data_2 = Data(deconstruct_mesh_2.Vertices)
is_mesh_disjoint = IsMeshDisjoint(Mesh=join_weld_meshes_3)  # -> Disjoint, Amount
mesh_11 = Mesh(construct_mesh_5)
mesh_closest_point_4 = MeshClosestPoint(Point=point_2, Mesh=mesh_11)  # -> Point, Index, Parameter
distance_4 = Distance(PointA=point_2, PointB=mesh_closest_point_4.Point)
larger_than_2 = LargerThan(FirstNumber=distance_4, SecondNumber=Slider(0.01, range=0..0.01))  # -> LargerThan, OrEqualTo
cull_pattern_2 = CullPattern(List=point_2, CullPattern=larger_than_2.LargerThan)
clean_tree = CleanTree(RemoveNulls=boolean_toggle, RemoveInvalid=boolean_toggle, RemoveEmpty=boolean_toggle, Tree=cull_pattern_2)
list_length_2 = ListLength(List=clean_tree)
mesh_12 = Mesh(mesh_11)
null_item = NullItem(Item=list_length_2)  # -> NullFlags, InvalidFlags, Description
mesh_area_2 = MeshArea(Mesh=mesh_12)  # -> Area, Centroid
stream_filter = StreamFilter(Gate=null_item.NullFlags, Stream0=list_length_2, Stream1="0")
multiplication_3 = Multiplication(A=stream_filter, B="10")
mesh_colours_4 = MeshColours(Mesh=mesh_11, Colours=ColourSwatch(SwatchColor=RGB(150, 7, 163)))
is_mesh_disjoint_2 = IsMeshDisjoint(Mesh=mesh_11)  # -> Disjoint, Amount
sort_list_2 = SortList(Keys=flatten([mesh_area_2.Area, division]), ValuesValuesA=flatten([mesh_area_2.Area, division]))  # -> Keys, simplify(graft(ValuesValuesA))
stream_gate = StreamGate(Stream=flatten([mesh_area_2.Area, mesh_area.Area]), Gate=stream_freeze_gate)  # -> Target0, Target1
sort_list_3 = SortList(Keys=flatten(stream_gate.Target1), ValuesValuesA=flatten(stream_gate.Target1))  # -> Keys, simplify(graft(ValuesValuesA))
explode_tree = ExplodeTree(Data=sort_list_2.ValuesValuesA)  # -> Branch0, Branch1
explode_tree_2 = ExplodeTree(Data=sort_list_3.ValuesValuesA)  # -> Branch0, Branch1
division_4 = Division(A=explode_tree.Branch0, B=explode_tree.Branch1)
division_5 = Division(A=explode_tree_2.Branch1, B=value_list)
sort_list_4 = SortList(Keys=flatten(stream_gate.Target1), ValuesValuesA=flatten(stream_gate.Target1))  # -> Keys, simplify(graft(ValuesValuesA))
sort_list_5 = SortList(Keys=flatten(stream_gate.Target0), ValuesValuesA=flatten(stream_gate.Target0))  # -> Keys, simplify(graft(ValuesValuesA))
subtraction_4 = Subtraction(A="1", B=division_4)
data_3 = Data(flatten([explode_tree_2.Branch0, division_5]))
explode_tree_3 = ExplodeTree(Data=sort_list_5.ValuesValuesA)  # -> Branch0, Branch1
explode_tree_4 = ExplodeTree(Data=sort_list_4.ValuesValuesA)  # -> Branch0, Branch1
list_length_3 = ListLength(List=data_2)
sort_list_6 = SortList(Keys=data_3, ValuesValuesA=data_3)  # -> Keys, simplify(graft(ValuesValuesA))
multiplication_4 = Multiplication(A=is_mesh_disjoint_2.Amount, B=Slider(2, range=1..25))
multiplication_5 = Multiplication(A=is_mesh_disjoint.Amount, B=Slider(2, range=1..25))
multiplication_6 = Multiplication(A=subtraction_4, B=Slider(110, range=0..1000))
division_6 = Division(A=explode_tree_3.Branch0, B=explode_tree_3.Branch1)
division_7 = Division(A=explode_tree_4.Branch1, B=value_list)
division_8 = Division(A=data, B=list_length_3)
multiplication_7 = Multiplication(A=list_length_3, B=division_2)
multiplication_8 = Multiplication(A=list_length_3, B=division_3)
addition_5 = Addition(A=multiplication_6, B=multiplication_4, C=multiplication_5, D=multiplication, E=multiplication_3)
explode_tree_5 = ExplodeTree(Data=sort_list_6.ValuesValuesA)  # -> Branch0, Branch1
data_4 = Data(flatten([explode_tree_4.Branch0, division_7]))
subtraction_5 = Subtraction(A="1", B=division_6)
multiplication_9 = Multiplication(A=is_mesh_disjoint_2.Amount, B=Slider(15, range=1..25))
multiplication_10 = Multiplication(A=is_mesh_disjoint.Amount, B=Slider(25, range=5..25))
stream_filter_2 = StreamFilter(Gate=stream_freeze_gate_2, Stream0=data, Stream1=addition_5)
multiplication_11 = Multiplication(A=Slider(180, range=50..180), B=subtraction_5)
stream_filter_3 = StreamFilter(Gate=boolean_toggle_2, Stream0=multiplication_8, Stream1=multiplication_7)
division_9 = Division(A=explode_tree_5.Branch0, B=explode_tree_5.Branch1)
sort_list_7 = SortList(Keys=data_4, ValuesValuesA=data_4)  # -> Keys, simplify(graft(ValuesValuesA))
addition_6 = Addition(A=multiplication_11, B=stream_filter_3, C=multiplication_9, D=multiplication_10)
multiplication_12 = Multiplication(A=division_8, B=stream_filter_3)
subtraction_6 = Subtraction(A="1", B=division_9)
explode_tree_6 = ExplodeTree(Data=sort_list_7.ValuesValuesA)  # -> Branch0, Branch1
multiplication_13 = Multiplication(A=Slider(120, range=1..170), B=subtraction_6)
division_10 = Division(A=explode_tree_6.Branch0, B=explode_tree_6.Branch1)
subtraction_7 = Subtraction(A="1", B=division_10)
multiplication_14 = Multiplication(A=is_mesh_disjoint_2.Amount, B=Slider(15, range=1..25))
multiplication_15 = Multiplication(A=Slider(120, range=1..170), B=subtraction_7)
addition_7 = Addition(A=multiplication_15, B=multiplication_12, C=multiplication_14)
stream_filter_4 = StreamFilter(Gate=subtraction, Stream0=addition_5, Stream1=addition_6, Stream2=addition_7)
data_5 = Data(stream_filter_4)
mesh_mesh_2 = MeshMesh(MeshA=mesh_11, MeshB=join_weld_meshes_3)
discontinuity = Discontinuity(Curve=mesh_mesh_2, Level=1)  # -> Points, Parameters
curveshatter = CurveShatter(Curve=mesh_mesh_2, Points=discontinuity.Points, Tolerance=0.01)
end_points = EndPoints(Curve=curveshatter)  # -> Start, End
cull_duplicates = CullDuplicates(Points=[end_points.Start, end_points.End], Tolerance=0.1, CullMode=3)  # -> Points, Indices, Valence
curve_closest_point = CurveClosestPoint(Point=flatten(cull_duplicates.Points), Curve=graft(join_curves))  # -> Point, Parameter, Distance
smaller_than_4 = SmallerThan(FirstNumber=curve_closest_point.Distance, SecondNumber=Slider(0.1, range=0..0.1))  # -> SmallerThan, OrEqualTo
cull_pattern_3 = CullPattern(List=curve_closest_point.Point, CullPattern=smaller_than_4.SmallerThan)
polyline = PolyLine(Vertices=flatten(cull_duplicates.Points), Closed=False)
curveshatter_2 = CurveShatter(Curve=polyline, Points=cull_duplicates.Points, Tolerance=0.01)
smooth_network_of_lines_by_daniel_piker = SmoothNetworkOfLinesByDanielPiker(Lines=curveshatter_2, Points=flatten(cull_pattern_3), Level=Slider(11, range=1..20), Tolerance=0.01)
curve_2 = Curve(smooth_network_of_lines_by_daniel_piker)
pulltomesh = CSharpScript(curve=curve_2, mesh=mesh_7)  # -> out, A; inputs curve: Curve, mesh: Mesh
# ---------- pulltomesh: C# usings ----------
using System.IO;
using System.Linq;
using System.Data;
using System.Drawing;
using System.Reflection;
using System.Windows.Forms;
using System.Xml;
using System.Xml.Linq;
using System.Runtime.InteropServices;

using Rhino.DocObjects;
using Rhino.Collections;
using GH_IO;
using GH_IO.Serialization;
# ---------- pulltomesh: C# ----------
    if (null != curve && null != mesh)
    {
      var tol = RhinoDoc.ActiveDoc.ModelAbsoluteTolerance;
      A = curve.PullToMesh(mesh, tol);
    }
# ---------- end pulltomesh ----------
divide_curve = DivideCurve(Curve=pulltomesh.A, Count=number_slider_5, Kinks=False)  # -> Points, Tangents, Parameters
vector_2pt = Vector2Pt(PointA=volume.Centroid, PointB=divide_curve.Points, Unitize=True)  # -> Vector, Length
reverse_4 = Reverse(Vector=vector_2pt.Vector)
project_point = ProjectPoint(Point=divide_curve.Points, Direction=vector_2pt.Vector, Geometry=scale.Geometry)  # -> Point, Index
amplitude = Amplitude(Vector=reverse_4, Amplitude=Slider(1.774, range=1..2))
move = Move(Geometry=divide_curve.Points, Motion=amplitude)  # -> Geometry, Transform
polyline_2 = PolyLine(Vertices=project_point.Point, Closed=boolean_toggle_3)
polyline_3 = PolyLine(Vertices=move.Geometry, Closed=boolean_toggle_3)
rebuild_curve = RebuildCurve(Curve=[polyline_3, polyline_2], Count=number_slider_5, Tangents=False)
loft = Loft(Curves=flatten(rebuild_curve), Options=loft_options)
mesh_brep_2 = MeshBrep(
    Brep=loft,
    Settings={GridMaxCount=0, GridMinCount=16, JaggedSeams=False, MaxEdgeLength=0, MinEdgeLength=0.0001, MinTolerance=0, Refine=True, RefineAngle=0, RelativeTolerance=0.65, SimplePlanes=True, Tolerance=0})
mesh_split = MeshSplit(Mesh=mesh_difference, Splitters=mesh_brep_2)
discrete_mesh_thickening = DiscreteMeshThickening(Mesh=mesh_brep_2, Distance=Slider(0.2, range=0..0.2))  # -> ThickMesh, InitialMesh, OffsetMesh, PerimeterMesh
explode_tree_7 = ExplodeTree(Data=simplify(graft(mesh_split)))  # -> _0000, Branch1, Branch2, Branch3
mesh_join_2 = MeshJoin(Meshes=flatten([explode_tree_7.Branch3, explode_tree_7._0000]))
mesh_join_3 = MeshJoin(Meshes=flatten([explode_tree_7.Branch2, explode_tree_7.Branch1]))
weld_mesh_2 = WeldMesh(Mesh=mesh_join_2, Angle=3.141592654)
weld_mesh_3 = WeldMesh(Mesh=mesh_join_3, Angle=3.141592654)
mesh_naked_edges = MeshNakedEdges(Mesh=weld_mesh_2)  # -> Edges, Indexes, IsNaked
join_curves_2 = JoinCurves(Curves=flatten(mesh_naked_edges.Edges), Preserve=False)
cut_mesh_with_polylines = CutMeshWithPolylines(Mesh=mesh_brep_2, Polylines=join_curves_2, Height=1, Tolerance=0.01, Seed=222, Color_Meshes=True)  # -> Ribbons, Meshes
mesh_face_count = MeshFaceCount(Mesh=cut_mesh_with_polylines.Meshes)
sort_list_8 = SortList(Keys=mesh_face_count, ValuesValuesA=cut_mesh_with_polylines.Meshes)  # -> Keys, ValuesValuesA
last_index = LastIndex(List=sort_list_8.ValuesValuesA)
list_item_2 = ListItem(List=sort_list_8.ValuesValuesA, Index=last_index, Wrap=True)
join_weld_meshes_4 = JoinWeldMeshes(Meshes=flatten([list_item_2, weld_mesh_2]))
join_weld_meshes_5 = JoinWeldMeshes(Meshes=flatten([weld_mesh_3, list_item_2]))
