# Grasshopper definition Tetrapod_remesh.gh (Grasshopper 1.0.8)
# plug-ins: Heteroptera, Pufferfish, Python, NGon_RH8

mesh = Mesh(<mesh referenced from the Rhino model>)  # disabled

brep = Brep(<brep referenced from the Rhino model>)
mesh_2 = MeshBrep(
    Brep=brep,
    Settings={GridMaxCount=0, GridMinCount=16, JaggedSeams=False, MaxEdgeLength=0, MinEdgeLength=0.0001, MinTolerance=0, Refine=True, RefineAngle=0, RelativeTolerance=0.65, SimplePlanes=True, Tolerance=0})
mesh_3 = Mesh(mesh_2)
mesh_4 = Mesh(<mesh referenced from the Rhino model>)

# ----
# Import mesh or brep
boolean_toggle = BooleanToggle(False)
panel = Panel(" fully organic")
bounding_box = BoundingBox(Content=mesh, Plane=PlaneXY(0, 0, 0))  # -> Box, Box_2; disabled
deconstruct_box = DeconstructBox(Box=bounding_box.Box)  # -> Plane, X, Y, Z; disabled
volume = Volume(Geometry=bounding_box.Box)  # -> Volume, Centroid; disabled
construct_point = ConstructPoint(XCoordinate=0, YCoordinate=0, ZCoordinate=0)  # disabled
deconstruct_domain = DeconstructDomain(Domain=deconstruct_box.X)  # -> Start, End; disabled
deconstruct_domain_2 = DeconstructDomain(Domain=deconstruct_box.Y)  # -> Start, End; disabled
deconstruct_domain_3 = DeconstructDomain(Domain=deconstruct_box.Z)  # -> Start, End; disabled
vector_2pt = Vector2Pt(PointA=volume.Centroid, PointB=construct_point, Unitize=False)  # -> Vector, Length; disabled
mesh_5 = Mesh([mesh_4, mesh_3])
sort_list = SortList(
    Keys=[deconstruct_domain.Start, deconstruct_domain.End],
    ValuesValuesA=[deconstruct_domain.Start, deconstruct_domain.End])  # -> Keys, ValuesValuesA; disabled
sort_list_2 = SortList(
    Keys=[deconstruct_domain_2.Start, deconstruct_domain_2.End],
    ValuesValuesA=[deconstruct_domain_2.Start, deconstruct_domain_2.End])  # -> Keys, ValuesValuesA; disabled
sort_list_3 = SortList(
    Keys=[deconstruct_domain_3.Start, deconstruct_domain_3.End],
    ValuesValuesA=[deconstruct_domain_3.Start, deconstruct_domain_3.End])  # -> Keys, ValuesValuesA; disabled

bbox = BoundingBox(Content=mesh_5, Plane=PlaneXY(0, 0, 0))  # -> Box, Box_2
volume_2 = Volume(Geometry=bbox.Box)  # -> Volume, Centroid
pt = ConstructPoint(XCoordinate=0, YCoordinate=0, ZCoordinate=0)
vec2pt = Vector2Pt(PointA=volume_2.Centroid, PointB=pt, Unitize=False)  # -> Vector, Length
move = Move(Geometry=mesh_5, Motion=vec2pt.Vector)  # -> Geometry, Transform
# Automatically orient to the CS centre
move_2 = Move(Geometry=volume_2.Centroid, Motion=vec2pt.Vector)  # -> Geometry, Transform

move_3 = Move(Geometry=mesh, Motion=vector_2pt.Vector)  # -> Geometry, Transform; disabled
explode_tree = ExplodeTree(Data=simplify(graft(sort_list.ValuesValuesA)))  # -> Branch0, Branch1; disabled
explode_tree_2 = ExplodeTree(Data=simplify(graft(sort_list_2.ValuesValuesA)))  # -> Branch0, Branch1; disabled
explode_tree_3 = ExplodeTree(Data=simplify(graft(sort_list_3.ValuesValuesA)))  # -> Branch0, Branch1; disabled
bounding_box_2 = BoundingBox(Content=move_3.Geometry, Plane=PlaneXY(0, 0, 0))  # -> Box, Box_2; disabled
subtraction = Subtraction(A=explode_tree.Branch1, B=explode_tree.Branch0)  # disabled
subtraction_2 = Subtraction(A=explode_tree_2.Branch1, B=explode_tree_2.Branch0)  # disabled
subtraction_3 = Subtraction(A=explode_tree_3.Branch1, B=explode_tree_3.Branch0)  # disabled
volume_3 = Volume(Geometry=bounding_box_2.Box)  # -> Volume, Centroid; disabled
panel_2 = Panel(subtraction_2)  # disabled
panel_3 = Panel(subtraction)  # disabled
panel_4 = Panel(subtraction_3)  # disabled

xy = XYPlane(Origin=move_2.Geometry)
rotworld = RotateWorld(
    Geometry=move.Geometry,
    Plane=xy,
    Axis1=0,
    Axis2=1,
    Axis3=2,
    Degrees1=Slider(0, range=-180..180),
    Degrees2=Slider(0, range=-180..180),
    Degrees3=Slider(0, range=-180..180))  # -> Rotated, Plane1, Plane2, Plane3, Transform

average = Average(Input=[subtraction, subtraction_2, subtraction_3])  # disabled
panel_5 = Panel("120")  # disabled
division = Division(A=average, B=panel_5)  # disabled
mesh_6 = Mesh(rotworld.Rotated)
panel_6 = Panel("1")  # disabled
addition = Addition(A=panel_6, B=division)  # disabled
python_3_script = Python3Script(mesh=mesh_6)  # -> out, a; inputs mesh: Mesh
# ---------- python_3_script: Python ----------
import Rhino
import Rhino.Geometry as rg
import System
# Remove parallel for now to debug step by step

import Rhino.Geometry as rg

# Check input type
print(f"Input type before conversion: {type(mesh)}")

# Convert Grasshopper Mesh to Rhino Mesh
if isinstance(mesh, rg.Mesh):
    print("Mesh is already a valid Rhino Mesh.")
elif hasattr(mesh, "ToBrep"):  # If it's a Grasshopper object
    print("Attempting to convert Grasshopper Mesh to Rhino Mesh.")
    mesh = rg.Mesh(mesh)
else:
    print("Mesh conversion failed.")

# Validate mesh
if isinstance(mesh, rg.Mesh) and mesh.Faces.Count > 0:
    print(f"Mesh is valid! Faces: {mesh.Faces.Count}, Vertices: {mesh.Vertices.Count}")
else:
    print("Mesh is still invalid!")


def area_of_triangle(a, b, c):
    """Calculate the area of a triangle given three points."""
    ab = b - a
    ac = c - a
    cross = rg.Vector3d.CrossProduct(ab, ac)
    return 0.5 * cross.Length

def compute_face_areas(mesh):
    """Computes areas of all mesh faces."""
    face_count = mesh.Faces.Count
    areas = []

    if face_count == 0:
        print("Mesh has no faces.")
        return []

    for i in range(face_count):  # Using a normal loop for debugging
        face = mesh.Faces[i]
        if face.IsTriangle:
            a, b, c = mesh.Vertices[face.A], mesh.Vertices[face.B], mesh.Vertices[face.C]
            areas.append(area_of_triangle(a, b, c))
        elif face.IsQuad:
            a, b, c, d = mesh.Vertices[face.A], mesh.Vertices[face.B], mesh.Vertices[face.C], mesh.Vertices[face.D]
            areas.append(area_of_triangle(a, b, c) + area_of_triangle(a, c, d))

    print(f"Computed {len(areas)} face areas.")
    return areas

# Main Execution:
if isinstance(mesh, System.Guid):  # If input is a Rhino GUID, convert it to Mesh
    rhino_obj = Rhino.RhinoDoc.ActiveDoc.Objects.Find(mesh)
    if rhino_obj:
        mesh = rhino_obj.Geometry  # Extract actual mesh

# Ensure the input is a valid Mesh before proceeding
if isinstance(mesh, rg.Mesh) and mesh.Faces.Count > 0:
    print(f"Mesh has {mesh.Faces.Count} faces and {mesh.Vertices.Count} vertices.")
    a = compute_face_areas(mesh)  # Output face areas
else:
    print("Invalid mesh input.")
    a = []  # Return an empty list if mesh is invalid
# ---------- end python_3_script ----------

deconstruct_mesh = DeconstructMesh(Mesh=mesh_6)  # -> Vertices, Faces, Colours, Normals
# Check for inconsistent face size
number_slider = Slider(150, range=50..500)
# check for low face count
list_length = ListLength(List=deconstruct_mesh.Faces)
smaller_than = SmallerThan(FirstNumber=list_length, SecondNumber=number_slider)  # -> SmallerThan, OrEqualTo

face_edge_lengths = FaceEdgeLengths(M=mesh_6, O=0)  # -> out, G, A, V, T, P; inputs M: Mesh
# ---------- face_edge_lengths: VB usings ----------
Imports System.IO
Imports System.Linq
Imports System.Data
Imports System.Drawing
Imports System.Reflection
Imports System.Windows.Forms
Imports System.Xml
Imports System.Xml.Linq
Imports Microsoft.VisualBasic
Imports System.Runtime.InteropServices

Imports Rhino.DocObjects
Imports Rhino.Collections
Imports GH_IO
Imports GH_IO.Serialization
# ---------- face_edge_lengths: VB ----------
    Component.Params.Input(0).Name = "Mesh"
    Component.Params.Input(0).Description = "Open or closed mesh"
    Component.Params.Input(1).Name = "Mode"
    Component.Params.Input(1).Description = "Designates which edge length to check against (0 = Average, 1 = Min, 2 = Max)"
    Component.Params.Input(2).Name = "Length Domain"
    Component.Params.Input(2).Description = "The domain that describes the range of lengths to be tested against"

    Component.Params.Output(1).Name = "Preview Mesh"
    Component.Params.Output(1).Description = "A greyscale preview mesh reflecting the range of values"
    Component.Params.Output(2).Name = "Lengths"
    Component.Params.Output(2).Description = "The length of each face's edge specified by the Mode input"
    Component.Params.Output(3).Name = "Values"
    Component.Params.Output(3).Description = "The list of all associated values to each sample point"
    Component.Params.Output(4).Name = "Topology"
    Component.Params.Output(4).Description = "The list of index values connected to the sample point"
    Component.Params.Output(5).Name = "Pattern"
    Component.Params.Output(5).Description = "If the R input is used, the status of each sample point relative to the provided range (0 = Below, 1 = Within, 2 = Above)"

    If M IsNot Nothing Then
      Dim i,j,k,s As Integer

      Dim iP As Grasshopper.Kernel.IGH_Param = Component.Params.Input(0)
      Dim cP As Grasshopper.Kernel.Data.IGH_Structure = iP.VolatileData

      Dim mf As Rhino.Geometry.Collections.MeshFaceList = Nothing
      Dim mfn As Rhino.Geometry.Collections.MeshFaceNormalList = Nothing
      Dim mv As Rhino.Geometry.Collections.MeshVertexList = Nothing
      Dim mtv As Rhino.Geometry.Collections.MeshTopologyVertexList = Nothing
      Dim mte As Rhino.Geometry.Collections.MeshTopologyEdgeList = Nothing
      Dim mn As Rhino.Geometry.Collections.MeshVertexNormalList = Nothing
      Dim mc As Rhino.Geometry.Collections.MeshVertexColorList = Nothing

      mf = m.Faces
      mfn = m.FaceNormals
      mv = m.Vertices
      mtv = m.TopologyVertices
      mte = m.TopologyEdges
      mn = m.Normals
      mc = m.VertexColors

      Dim avgAng As New list(Of Double)
      Dim arrVal As New datatree(Of Double)
      Dim arrTop As New datatree(Of Integer)
      Dim oc As New list(Of color)
      Dim tv As Integer
      Dim aMin, aMax As Double
      Dim arrPat As New list(Of Integer)

      Dim mfo As New list(Of MeshFace)
      Dim mvo As New list(Of point3d)

      For i = 0 To mf.count() - 1 Step 1
        Dim tcv() As Integer
        tcv = mte.GetEdgesForFace(i)
        s = mvo.count()

        k = ((tcv.Length - 1) + 1)

        If mf.item(i).isquad() Then
          mvo.add(mv.item(mf.item(i).A))
          mvo.add(mv.item(mf.item(i).B))
          mvo.add(mv.item(mf.item(i).C))
          mvo.add(mv.item(mf.item(i).D))
          mfo.add(New meshface(s, s + 1, s + 2, s + 3))
        Else
          mvo.add(mv.item(mf.item(i).A))
          mvo.add(mv.item(mf.item(i).B))
          mvo.add(mv.item(mf.item(i).C))
          mfo.add(New meshface(s, s + 1, s + 2))
        End If

        Dim tang,ang, tMin, tMax As New Double
        For j = 0 To k - 1 Step 1
          tang = mte.EdgeLine(tcv(j)).Length
          arrVal.add(tang, cp.Path(Component.RunCount - 1).AppendElement(i))
          arrTop.add(tcv(j), cp.Path(Component.RunCount - 1).AppendElement(i))
          ang += tang
          If j = 0 Then tMin = tang Else If tang < tMin Then tMin = tang
          If tang > tMax Then tMax = tang
        Next

        If O = 1 Then
          ang = tMin
        ElseIf O = 2 Then
          ang = tMax
        Else
          ang /= k
        End If

        If i = 0 Then aMin = ang Else If ang < aMin Then aMin = ang
        If ang > aMax Then aMax = ang

        avgAng.add(ang)
      Next

      If R = Nothing Then
        R.t0 = amin
        R.t1 = amax
      End If

      For i = 0 To mf.count() - 1 Step 1
        If mf.item(i).isquad() Then k = 4 Else k = 3

        If avgAng.item(i) < R.T0 Then
          For j = 0 To k - 1 Step 1
            oc.add(color.FromArgb(0, 0, 255))
          Next
          arrPat.add(0)
        ElseIf ((avgAng.item(i) > R.T1) Or ((r.t0 = 0) And (r.t1 = 0))) Then
          For j = 0 To k - 1 Step 1
            oc.add(color.FromArgb(255, 0, 0))
          Next
          arrPat.add(2)
        Else
          For j = 0 To k - 1 Step 1
            tv = math.Floor((avgAng.item(i) - R.T0) / (R.t1 - R.t0) * 255)
            oc.add(color.FromArgb(tv, tv, tv))
          Next
          arrPat.add(1)
        End If
      Next
      Dim mo As New mesh
      mo.vertices.AddVertices(mvo.toarray())
      mo.Faces.AddFaces(mfo.toarray())
      mo.VertexColors.AppendColors(oc.toarray())

      G = mo
      V = arrVal
      A = avgAng
      P = arrPat
      T = arrTop

    End If
# ---------- end face_edge_lengths ----------
min_max = MinMax(Number=face_edge_lengths.V)  # -> Minimum, Maximum
division_2 = Division(A=min_max.Maximum, B=min_max.Minimum)
larger_than = LargerThan(FirstNumber=division_2, SecondNumber=Slider(7, range=5..10))  # -> LargerThan, OrEqualTo
mass_addition = MassAddition(Input=flatten(larger_than.LargerThan))  # -> Result, PartialResults
division_3 = Division(A=list_length, B=Slider(15, range=5..25))
larger_than_2 = LargerThan(FirstNumber=mass_addition.Result, SecondNumber=division_3)  # -> LargerThan, OrEqualTo

scale = Scale(Geometry=move_3.Geometry, Center=volume_3.Centroid, Factor=addition)  # -> Geometry, Transform; disabled

min_max_2 = MinMax(Number=python_3_script.a)  # -> Minimum, Maximum
# check for elongated triangles
number_slider_2 = Slider(2, range=2..50)
division_4 = Division(A=min_max_2.Maximum, B=min_max_2.Minimum)
larger_than_3 = LargerThan(FirstNumber=division_4, SecondNumber=number_slider_2)  # -> LargerThan, OrEqualTo

# ----
# Is it a bad mesh?
boolean = Boolean([larger_than_2.LargerThan, larger_than_3.LargerThan, smaller_than.SmallerThan])
# bad mesh yes or no, if yes we'll remesh
mass_addition_2 = MassAddition(Input=boolean)  # -> Result, PartialResults
list_length_2 = ListLength(List=boolean)
smaller_than_2 = SmallerThan(FirstNumber=mass_addition_2.Result, SecondNumber=list_length_2)  # -> SmallerThan, OrEqualTo
panel_7 = Panel(smaller_than_2.SmallerThan)
stream_gate = StreamGate(Stream=mesh_6, Gate=smaller_than_2.SmallerThan)  # -> Target0, Target1

edge_shared_face_angles = EdgeSharedFaceAngles(M=stream_gate.Target1)  # -> out, G, A, T, P
# ---------- edge_shared_face_angles: VB ----------
    Component.Params.Input(0).Name = "Mesh"
    Component.Params.Input(0).Description = "Open or closed mesh"
    Component.Params.Input(1).Name = "Angle Domain"
    Component.Params.Input(1).Description = "The domain that describes the range of angles to be tested against"

    Component.Params.Output(1).Name = "Preview Mesh"
    Component.Params.Output(1).Description = "A greyscale preview mesh reflecting the range of values"
    Component.Params.Output(2).Name = "Angle"
    Component.Params.Output(2).Description = "A list of the angle values between the two faces that share an interior edge, and a value of 0 for naked edges"
    Component.Params.Output(3).Name = "Topology"
    Component.Params.Output(3).Description = "The list of index values connected to the sample point"
    Component.Params.Output(4).Name = "Pattern"
    Component.Params.Output(4).Description = "If the R input is used, the status of each sample point relative to the provided range (0 = Below, 1 = Within, 2 = Above)"

    If M IsNot Nothing Then
      Dim i,j,s As Integer

      Dim iP As Grasshopper.Kernel.IGH_Param = Component.Params.Input(0)
      Dim cP As Grasshopper.Kernel.Data.IGH_Structure = iP.VolatileData

      Dim mf As Rhino.Geometry.Collections.MeshFaceList = Nothing
      Dim mfn As Rhino.Geometry.Collections.MeshFaceNormalList = Nothing
      Dim mv As Rhino.Geometry.Collections.MeshVertexList = Nothing
      Dim mtv As Rhino.Geometry.Collections.MeshTopologyVertexList = Nothing
      Dim mte As Rhino.Geometry.Collections.MeshTopologyEdgeList = Nothing
      Dim mn As Rhino.Geometry.Collections.MeshVertexNormalList = Nothing
      Dim mc As Rhino.Geometry.Collections.MeshVertexColorList = Nothing

      If M.facenormals.count() = 0 Then M.FaceNormals.ComputeFaceNormals()

      mf = m.Faces
      mfn = m.facenormals
      mv = m.Vertices
      mtv = m.TopologyVertices
      mte = m.TopologyEdges
      mn = m.Normals
      mc = m.VertexColors

      Dim avgV As New list(Of Double)
      Dim arrTop As New datatree(Of Integer)
      Dim oc As New list(Of color)
      Dim ovc As New list(Of Point3d)
      Dim omf As New list(Of MeshFace)
      Dim tv As Integer
      Dim ang,tmin,tmax As Double
      Dim arrPat As New list(Of Integer)

      For i = 0 To mte.count() - 1 Step 1
        s = ovc.count()
        Dim ln As line
        ln = mte.EdgeLine(i)
        Dim cfc() As Integer
        cfc = mte.GetConnectedFaces(i)

        If (cfc.Length - 1) = 0 Then
          ang = 0
          arrTop.add(cfc(0), cp.Path(Component.RunCount - 1).AppendElement(i))
        Else
          ang = vector3d.VectorAngle(mfn.item(cfc(0)), mfn.item(cfc(1)))
          arrTop.add(cfc(0), cp.Path(Component.RunCount - 1).AppendElement(i))
          arrTop.add(cfc(1), cp.Path(Component.RunCount - 1).AppendElement(i))
        End If
        ovc.add(ln.From)
        ovc.add(ln.To)
        For j = 0 To (cfc.Length - 1) Step 1
          ovc.add(evalP(ln.To, mf.GetFaceCenter(cfc(j)), 0.25))
          ovc.add(evalP(ln.From, mf.GetFaceCenter(cfc(j)), 0.25))
          omf.add(New meshface(s, s + 1, s + 2 + j * 2, s + 3 + j * 2))
        Next
        If i = 0 Then Tmin = ang Else If ang < Tmin Then Tmin = ang
        If ang > Tmax Then Tmax = ang
        avgV.add(ang)
      Next

      For i = 0 To mte.count() - 1 Step 1
        If R = Nothing Then
          R.t0 = Tmin
          R.t1 = Tmax
        End If

        Dim cfca() As Integer
        cfca = mte.GetConnectedFaces(i)
        If avgV.item(i) < R.T0 Then
          For j = 0 To (cfca.Length - 1) * 2 + 3 Step 1
            oc.add(color.FromArgb(0, 0, 255))
            arrPat.add(0)
          Next
        ElseIf ((avgV.item(i) > R.T1) Or ((R.t0 = 0) And (R.t1 = 0))) Then
          For j = 0 To (cfca.Length - 1) * 2 + 3 Step 1
            oc.add(color.FromArgb(255, 0, 0))
            arrPat.add(2)
          Next
        Else
          For j = 0 To (cfca.Length - 1) * 2 + 3 Step 1
            tv = math.Floor((avgV.item(i) - R.T0) / (R.t1 - R.t0) * 255)
            oc.add(color.FromArgb(tv, tv, tv))
            arrPat.add(1)
          Next
        End If
      Next

      Dim mo As New mesh
      mo.vertices.AddVertices(ovc)
      mo.Faces.AddFaces(omf)
      mo.VertexColors.AppendColors(oc.toarray())

      G = mo
      A = avgV
      P = arrPat
      T = arrTop
    End If
# ---------- edge_shared_face_angles: VB additional code ----------
  Private Function evalP(ByVal op As point3d, ByVal tp As Point3d, ByVal t As Double)
    Return New point3d(op + (tp - op) * t)
  End Function
# ---------- end edge_shared_face_angles ----------
extract_edges = ExtractEdges(M=stream_gate.Target1)  # -> out, L, A, B; inputs M: Mesh
# ---------- extract_edges: VB ----------
    Component.Params.Input(0).Name = "Mesh"
    Component.Params.Input(0).Description = "Open or closed mesh"

    Component.Params.Output(1).Name = "Lines"
    Component.Params.Output(1).Description = "All the edges of the mesh output at lines in topological order"
    Component.Params.Output(2).Name = "Index 1"
    Component.Params.Output(2).Description = "Index of one of the topology vertices which defines the edge"
    Component.Params.Output(3).Name = "Index 2"
    Component.Params.Output(3).Description = "Index of one of the topology vertices which defines the edge"

    If m IsNot Nothing Then
      Dim mte As Rhino.Geometry.Collections.MeshTopologyEdgeList
      Dim arrL As New list(Of line)
      Dim arrI, arrJ As New list(Of Integer)
      Dim i As Integer

      mte = M.TopologyEdges()

      For i = 0 To mte.count() - 1 Step 1
        arrL.add(mte.EdgeLine(i))
        arrI.add(mte.GetTopologyVertices(i).I)
        arrJ.add(mte.GetTopologyVertices(i).J)
      Next

      L = arrL
      A = arrI
      B = arrJ
    end if
# ---------- end extract_edges ----------
radians = Radians(Degrees=Slider(30, range=1..90))
larger_than_4 = LargerThan(FirstNumber=edge_shared_face_angles.A, SecondNumber=radians)  # -> LargerThan, OrEqualTo
cull_pattern = CullPattern(List=extract_edges.L, CullPattern=larger_than_4.LargerThan)

ghpython_script = GhPythonScript(g=stream_gate.Target1)  # -> out, a, b
# ---------- ghpython_script: Python ----------
import Rhino.Geometry as rg
import itertools

def shortest_diagonal(geometry):
    # Get bounding box
    bbox = geometry.GetBoundingBox(True)
    
    # Get the corner points of the bounding box (8 corners)
    corners = bbox.GetCorners()
    
    # Generate all diagonals (pairs of opposite corners)
    diagonals = [
        (p1.DistanceTo(p2), (p1, p2)) for p1, p2 in itertools.combinations(corners, 2) if p1 != p2
    ]
    
    # Find the shortest diagonal
    min_diag = min(diagonals, key=lambda d: d[0])
    
    return min_diag[1], min_diag[0]  # Return the shortest diagonal points and length

# Grasshopper inputs
geometry = g  # Input geometry (should be referenced in Grasshopper)

if geometry:
    diag_points, diag_length = shortest_diagonal(geometry)
else:
    diag_points, diag_length = None, None

# Grasshopper outputs
a = diag_points  # The two points defining the shortest diagonal
b = diag_length  # The length of the shortest diagonal
# ---------- end ghpython_script ----------
division_5 = Division(A=ghpython_script.b, B=Slider(30, range=10..200))
smaller_than_3 = SmallerThan(FirstNumber=division_5, SecondNumber="0.3")  # -> SmallerThan, OrEqualTo
stream_filter = StreamFilter(Gate=smaller_than_3.SmallerThan, Stream0=division_5, Stream1="0.3")

invert_boolean = InvertBoolean(Boolean=boolean_toggle)  # -> Inverted, Number
stream_freeze_gate = StreamFreezeGate(Data=cull_pattern, PassingSwitch=invert_boolean.Inverted)

# ----
# shortest diagonal of a box, if it's shorter than one, we'll use one as the size for the mesh
panel_8 = Panel("sharp edges")
triremesh = TriRemesh(
    Geometry=stream_gate.Target1,
    Sharp=invert_boolean.Inverted,
    Features=stream_freeze_gate,
    Length=stream_filter,
    Iterations=Slider(30, range=1..40))  # -> Triangulation, Dual, Creases
join_weld_meshes = JoinWeldMeshes(Meshes=triremesh.Triangulation)
mesh_7 = Mesh(join_weld_meshes)

panel_9 = Panel(" remesh if needed")
mesh_8 = Mesh(stream_gate.Target0)
# mesh to work with
mesh_9 = Mesh(flatten([mesh_8, mesh_7]))
mesh_edges = MeshEdges(Mesh=mesh_9)  # -> AllE, NakedE
