# Grasshopper definition Compl_DD_0.01.gh (Grasshopper 1.0.8)
# plug-ins: GhPython Script

panel = Panel("mesh vorm")
panel_2 = Panel("meshes gesplitste mal")
mesh = Mesh([<mesh referenced from the Rhino model> x4])
mesh_2 = Mesh(<mesh referenced from the Rhino model>)
mesh_3 = Mesh(mesh_2)
mesh_join = MeshJoin(Meshes=mesh)
deconstruct_mesh = DeconstructMesh(Mesh=mesh_3)  # -> Vertices, Faces, Colours, Normals
bounding_box = BoundingBox(Content=mesh_join, Plane=PlaneXY(0, 0, 0))  # -> Box, Box_2
list_length = ListLength(List=deconstruct_mesh.Vertices)
mesh_brep = MeshBrep(
    Brep=bounding_box.Box,
    Settings={GridMaxCount=0, GridMinCount=16, JaggedSeams=False, MaxEdgeLength=0, MinEdgeLength=0.0001, MinTolerance=0, Refine=True, RefineAngle=0, RelativeTolerance=0.65, SimplePlanes=True, Tolerance=0})
series = Series(Start=0, Step=1, Count=list_length)
mesh_4 = Mesh(mesh_brep)
vertexneighbours = VertexNeighbours(Mesh=mesh_3, VertexNumber=series)  # -> simplify(graft(Vertex)), simplify(Neighbours), Normal
deconstruct = Deconstruct(Point=vertexneighbours.Vertex)  # -> XComponent, YComponent, ZComponent
deconstruct_2 = Deconstruct(Point=vertexneighbours.Neighbours)  # -> XComponent, YComponent, ZComponent
larger_than = LargerThan(FirstNumber=deconstruct.ZComponent, SecondNumber=deconstruct_2.ZComponent)  # -> LargerThan, OrEqualTo
mass_multiplication = MassMultiplication(Input=larger_than.OrEqualTo)  # -> Result, PartialResults
cull_pattern = CullPattern(List=vertexneighbours.Vertex, CullPattern=mass_multiplication.Result)  # -> simplify(flatten(List))
cull_duplicates = CullDuplicates(Points=cull_pattern, Tolerance=0.1, CullMode=3)  # -> flatten(Points), Indices, Valence
point_groups = PointGroups(Points=cull_duplicates.Points, Distance=Slider(15, range=0..20))  # -> Groups, Indices
average = Average(Input=point_groups.Groups)
pull_point = PullPoint(Point=average, Geometry=mesh_3, ClosestOnly=True)  # -> flatten(ClosestPoint), Distance, Index
deconstruct_3 = Deconstruct(Point=pull_point.ClosestPoint)  # -> XComponent, YComponent, ZComponent
larger_than_2 = LargerThan(FirstNumber=deconstruct_3.ZComponent, SecondNumber="0")  # -> LargerThan, OrEqualTo
cull_pattern_2 = CullPattern(List=pull_point.ClosestPoint, CullPattern=larger_than_2.LargerThan)
deconstruct_4 = Deconstruct(Point=cull_pattern_2)  # -> XComponent, YComponent, ZComponent
sort_list = SortList(Keys=deconstruct_4.ZComponent, ValuesValuesA=cull_pattern_2)  # -> Keys, ValuesValuesA
reverse_list = ReverseList(List=sort_list.ValuesValuesA)
unit_z = UnitZ(Factor=1)
split_list = SplitList(List=reverse_list, Index="1")  # -> ListA, ListB
project_points = ProjectPoints(Geometries=mesh_4, Points=split_list.ListA, Vector=unit_z)  # -> Points, Index
deconstruct_5 = Deconstruct(Point=project_points.Points)  # -> XComponent, YComponent, ZComponent
unit_z_2 = UnitZ(Factor=1)
sort_list_2 = SortList(Keys=deconstruct_5.ZComponent, ValuesValuesA=project_points.Points)  # -> Keys, ValuesValuesA
deconstruct_6 = Deconstruct(Point=split_list.ListA)  # -> XComponent, YComponent, ZComponent
reverse = Reverse(Vector=unit_z_2)
reverse_list_2 = ReverseList(List=sort_list_2.ValuesValuesA)
number_slider = Slider(2, range=0..10)
list_item = ListItem(List=reverse_list_2, Index=0, Wrap=True)
bounding_box_2 = BoundingBox(Content=mesh_4, Plane=PlaneXY(0, 0, 0))  # -> Box, Box_2
deconstruct_box = DeconstructBox(Box=bounding_box_2.Box)  # -> Plane, X, Y, Z
plane_normal = PlaneNormal(Origin=list_item, ZAxis=reverse)
deconstruct_7 = Deconstruct(Point=list_item)  # -> XComponent, YComponent, ZComponent
subtraction = Subtraction(A=number_slider, B=1)
unit_z_3 = UnitZ(Factor=1)
deconstruct_8 = Deconstruct(Point=split_list.ListB)  # -> XComponent, YComponent, ZComponent
unit_z_4 = UnitZ(Factor=subtraction)
number_slider_2 = Slider(5, range=0..10)
deconstruct_domain = DeconstructDomain(Domain=deconstruct_box.Z)  # -> Start, End
bounding_box_3 = BoundingBox(Content=mesh_4, Plane=PlaneXY(0, 0, 0))  # -> Box, Box_2
subtraction_2 = Subtraction(A=deconstruct_7.ZComponent, B=deconstruct_6.ZComponent)
negative = Negative(Value=unit_z_4)
move = Move(Geometry=plane_normal, Motion=unit_z_3)  # -> Geometry, Transform
addition = Addition(A=subtraction_2, B=number_slider)
subtraction_3 = Subtraction(A=number_slider_2, B=1)
construct_point = ConstructPoint(XCoordinate=deconstruct_8.XComponent, YCoordinate=deconstruct_8.YComponent, ZCoordinate=deconstruct_domain.End)
deconstruct_box_2 = DeconstructBox(Box=bounding_box_3.Box)  # -> Plane, X, Y, Z
move_2 = Move(Geometry=split_list.ListA, Motion=negative)  # -> Geometry, Transform
unit_z_5 = UnitZ(Factor=subtraction_3)
division = Division(A="10", B=2)
deconstruct_domain_2 = DeconstructDomain(Domain=deconstruct_box_2.Z)  # -> Start, End
unit_z_6 = UnitZ(Factor=1)
plane_normal_2 = PlaneNormal(Origin=construct_point, ZAxis=reverse)
mesh_5 = Mesh(mesh)
cylinder = Cylinder(Base=move.Geometry, Radius=division, Length=addition)
cone = Cone(Base=move.Geometry, Radius="10", Length=Slider(7, range=2..10))  # -> Cone, Tip
sphere = Sphere(Base=move_2.Geometry, Radius=division)
negative_2 = Negative(Value=unit_z_5)
subtraction_4 = Subtraction(A=deconstruct_domain_2.End, B=deconstruct_8.ZComponent)
move_3 = Move(Geometry=split_list.ListB, Motion=negative_2)  # -> Geometry, Transform
cap_holes = CapHoles(Brep=[cone.Cone, cylinder, sphere])
addition_2 = Addition(A=subtraction_4, B=number_slider_2)
move_4 = Move(Geometry=plane_normal_2, Motion=unit_z_6)  # -> Geometry, Transform
solid_union = SolidUnion(Breps=flatten(cap_holes))
mesh_brep_2 = MeshBrep(
    Brep=solid_union,
    Settings={GridMaxCount=0, GridMinCount=16, JaggedSeams=False, MaxEdgeLength=0, MinEdgeLength=0.0001, MinTolerance=0, Refine=True, RefineAngle=0, RelativeTolerance=0.65, SimplePlanes=True, Tolerance=0})
division_2 = Division(A="5", B=2)
cylinder_2 = Cylinder(Base=move_4.Geometry, Radius=division_2, Length=addition_2)
sphere_2 = Sphere(Base=move_3.Geometry, Radius=division_2)
cap_holes_2 = CapHoles(Brep=[sphere_2, cylinder_2])
solid_union_2 = SolidUnion(Breps=flatten(cap_holes_2))
mesh_brep_3 = MeshBrep(
    Brep=solid_union_2,
    Settings={GridMaxCount=0, GridMinCount=16, JaggedSeams=False, MaxEdgeLength=0, MinEdgeLength=0.0001, MinTolerance=0, Refine=True, RefineAngle=0, RelativeTolerance=0.65, SimplePlanes=True, Tolerance=0})
mesh_difference = MeshDifference(MeshesA=mesh_5, MeshesB=flatten([mesh_brep_2, mesh_brep_3]))  # disabled
