# Grasshopper definition Symm_base_0.02.gh (Grasshopper 1.0.8)
# plug-ins: Heteroptera, MeshEdit Components, Pufferfish, Python, LunchBox, BlueOrange, Stripper, Opossum2_0_Proto_A, Nautilus, IntraLattice

value_list = ValueList({"Two": 2, "Three": 3, "Four": 4}, selected="Two")
panel = Panel(" est. mould parts")
number_slider = Slider(-25, range=-180..180)
number_slider_2 = Slider(-32, range=-180..180)
number_slider_3 = Slider(116, range=-180..180)
# Major pull direction
opossum = Opossum(OpossumData_objective=data_4, OpossumData_variable=[number_slider, number_slider_2, number_slider_3])
dom = ConstructDomain(DomainStart="-1", DomainEnd="1")
# input mesh - should be looped untill undercut region is 0
mesh = Mesh(<mesh referenced from the Rhino model>)
panel_2 = Panel("base mesh")
mesh_2 = Mesh(<mesh referenced from the Rhino model>)
panel_3 = Panel("find mesh occlusion")
panel_4 = Panel(" angle tolerance")
python_3_script = Python3Script(M=mesh_2, Threshold=Slider(60, range=0..100))  # -> out, SharpEdges; inputs M: Mesh, Threshold: Double
# ---------- python_3_script: Python ----------
import Rhino.Geometry as rg
import math

sharp_edges = []

angle_threshold = math.radians(Threshold)

M.RebuildNormals()
M.FaceNormals.ComputeFaceNormals()

topo = M.TopologyEdges
face_normals = M.FaceNormals
face_count = M.Faces.Count

for i in range(topo.Count):
    connected_faces = topo.GetConnectedFaces(i)
    if len(connected_faces) == 2:
        f1, f2 = connected_faces
        if f1 < face_count and f2 < face_count:
            n1 = rg.Vector3d(face_normals[f1])
            n2 = rg.Vector3d(face_normals[f2])
            angle = rg.Vector3d.VectorAngle(n1, n2)

            # Debug print
            print("Edge {}: {:.2f} degrees".format(i, math.degrees(angle)))

            if angle > angle_threshold:
                edge_line = topo.EdgeLine(i)
                sharp_edges.append(edge_line)

SharpEdges = sharp_edges
# ---------- end python_3_script ----------
panel_5 = Panel("undercut points")
panel_6 = Panel(" hard edges")
panel_7 = Panel("to minimize")
panel_8 = Panel("leftover mesh")
panel_9 = Panel("good mesh")
panel_10 = Panel(" total vertice count")
equality = Equality(FirstNumber=value_list, SecondNumber=2)  # -> Equality, Inequality
panel_11 = Panel("target mesh")
panel_12 = Panel("total mesh")
boolean_toggle = BooleanToggle(True)
panel_13 = Panel(" approx. symmetrical")
panel_14 = Panel("undercuts")
mesh_3 = Mesh(mesh)
mesh_4 = Mesh(mesh_2)
mesh_area = MeshArea(Mesh=mesh_4)  # -> Area, Centroid
mesh_area_2 = MeshArea(Mesh=mesh_3)  # -> Area, Centroid
stream_freeze_gate = StreamFreezeGate(Data=boolean_toggle, PassingSwitch=equality.Inequality)
stream_gate = StreamGate(Stream=flatten([mesh_area_2.Area, mesh_area.Area]), Gate=stream_freeze_gate)  # -> Target0, Target1

panel_15 = Panel("if symmetric")
stream_filter = StreamFilter(Gate=boolean_toggle, Stream0="1", Stream1=value_list)

sort_list = SortList(Keys=flatten(stream_gate.Target1), ValuesValuesA=flatten(stream_gate.Target1))  # -> Keys, simplify(graft(ValuesValuesA))
explode_tree = ExplodeTree(Data=sort_list.ValuesValuesA)  # -> Branch0, Branch1
# mesh surface vs total mesh surface
division = Division(A=explode_tree.Branch1, B=value_list)
data = Data(flatten([explode_tree.Branch0, division]))
# number of undercuts in relation to total vertice count
sort_list_2 = SortList(Keys=data, ValuesValuesA=data)  # -> Keys, simplify(graft(ValuesValuesA))
explode_tree_2 = ExplodeTree(Data=sort_list_2.ValuesValuesA)  # -> Branch0, Branch1
division_2 = Division(A=explode_tree_2.Branch0, B=explode_tree_2.Branch1)
subtraction = Subtraction(A="1", B=division_2)
multiplication = Multiplication(A=Slider(170, range=1..170), B=subtraction)

division_3 = Division(A=mesh_area.Area, B=stream_filter)
sort_list_3 = SortList(Keys=flatten([mesh_area_2.Area, division_3]), ValuesValuesA=flatten([mesh_area_2.Area, division_3]))  # -> Keys, simplify(graft(ValuesValuesA))
explode_tree_3 = ExplodeTree(Data=sort_list_3.ValuesValuesA)  # -> Branch0, Branch1
division_4 = Division(A=explode_tree_3.Branch0, B=explode_tree_3.Branch1)
subtraction_2 = Subtraction(A="1", B=division_4)
multiplication_2 = Multiplication(A=subtraction_2, B=Slider(110, range=0..1000))

sort_list_4 = SortList(Keys=flatten(stream_gate.Target0), ValuesValuesA=flatten(stream_gate.Target0))  # -> Keys, simplify(graft(ValuesValuesA))
explode_tree_4 = ExplodeTree(Data=sort_list_4.ValuesValuesA)  # -> Branch0, Branch1
division_5 = Division(A=explode_tree_4.Branch0, B=explode_tree_4.Branch1)
# mesh surface vs total mesh surface
panel_16 = Panel("1")
subtraction_3 = Subtraction(A=panel_16, B=division_5)
multiplication_3 = Multiplication(A=Slider(180, range=50..180), B=subtraction_3)

panel_17 = Panel("mesh area")
panel_19 = Panel("two part mould")
subtraction_4 = Subtraction(A=value_list, B=2)
panel_20 = Panel(" subdivided base mesh")
panel_21 = Panel(" mesh 2")
panel_22 = Panel("mesh 1")
panel_23 = Panel("mesh 3")
mesh_5 = Mesh(<mesh referenced from the Rhino model>)
mesh_6 = Mesh(<mesh referenced from the Rhino model>)

panel_24 = Panel("Angle treshold")
# custom detect hard edges
python_3_script_2 = Python3Script(M=mesh_2, Threshold=Slider(60, range=0..100))  # -> out, SharpEdges; inputs M: Mesh, Threshold: Double; same code as python_3_script
curve = Curve(python_3_script_2.SharpEdges)
join_curves = JoinCurves(Curves=curve, Preserve=False)

mesh_mesh = MeshMesh(MeshA=mesh_5, MeshB=flatten(mesh_6))
panel_25 = Panel("part edges")
panel_26 = Panel("1-2")
# pull polyline to the mesh + smooth soft edges + detect hard edges
cluster = Cluster(curve_2=mesh_mesh, curve_3=join_curves, curve=mesh_mesh)
curve_2 = Curve(flatten(cluster))
join_curves_2 = JoinCurves(Curves=flatten(curve_2), Preserve=False)
mesh_7 = Mesh(mesh_2)
curve_3 = Curve(join_curves_2)
# pull line to mesh again
pulltomesh = CSharpScript(curve=curve_3, mesh=mesh_7)  # -> out, A; inputs curve: Curve, mesh: Mesh
# ---------- pulltomesh: C# usings ----------
using System.IO;
using System.Linq;
using System.Data;
using System.Drawing;
using System.Reflection;
using System.Windows.Forms;
using System.Xml;
using System.Xml.Linq;
using System.Runtime.InteropServices;

using Rhino.DocObjects;
using Rhino.Collections;
using GH_IO;
using GH_IO.Serialization;
# ---------- pulltomesh: C# ----------
    if (null != curve && null != mesh)
    {
      var tol = RhinoDoc.ActiveDoc.ModelAbsoluteTolerance;
      A = curve.PullToMesh(mesh, tol);
    }
# ---------- end pulltomesh ----------

volume = Volume(Geometry=mesh_7)  # -> Volume, Centroid
bounding_box = BoundingBox(Content=mesh_7, Plane=PlaneXY(0, 0, 0))  # -> Box, Box_2
number_slider_4 = Slider(1.2, range=1..2)
subtraction_5 = Subtraction(A=number_slider_4, B=0.05)
scale = Scale(Geometry=bounding_box.Box, Center=volume.Centroid, Factor=subtraction_5)  # -> Geometry, Transform
scale_2 = Scale(Geometry=bounding_box.Box, Center=volume.Centroid, Factor=number_slider_4)  # -> Geometry, Transform

panel_27 = Panel(" mould base shape")
panel_28 = Panel("oversized box")
panel_29 = Panel("mould box")

divide_curve = DivideCurve(Curve=pulltomesh.A, Count=Slider(1000, range=0..1000), Kinks=False)  # -> Points, Tangents, Parameters
construct_point = ConstructPoint(XCoordinate=0, YCoordinate=0, ZCoordinate=0)
vector_2pt = Vector2Pt(PointA=construct_point, PointB=divide_curve.Points, Unitize=False)  # -> Vector, Length
amplitude = Amplitude(Vector=vector_2pt.Vector, Amplitude="-1")
project_point = ProjectPoint(Point=divide_curve.Points, Direction=vector_2pt.Vector, Geometry=scale_2.Geometry)  # -> Point, Index
move = Move(Geometry=divide_curve.Points, Motion=amplitude)  # -> Geometry, Transform
line = Line(StartPoint=move.Geometry, EndPoint=project_point.Point)
loftmesh = LoftMesh(Polylines=line, CloseLoft=False)
join_weld_meshes = JoinWeldMeshes(Meshes=flatten(loftmesh))
weld_the_vertices_of_a_mesh = WeldTheVerticesOfAMesh(Mesh=join_weld_meshes, Tolerance=Slider(0.7, range=0..1.41))

boolean_toggle_2 = BooleanToggle(True)
mesh_brep = MeshBrep(
    Brep=scale.Geometry,
    Settings={GridMaxCount=0, GridMinCount=16, JaggedSeams=False, MaxEdgeLength=0, MinEdgeLength=0.0001, MinTolerance=0, Refine=True, RefineAngle=0, RelativeTolerance=0.65, SimplePlanes=True, Tolerance=0})
quad_remesh_parameters = QuadRemeshParameters(
    TargetQuadCount=Slider(3000, range=0..100000),
    UseAdaptiveQuads=True,
    AdaptiveQuadSize=50,
    DetectHardEdges=boolean_toggle_2,
    PreserveMeshArrayHardEdges=boolean_toggle_2,
    SymmetryAxis=0,
    GuideCurveInfluence=0,
    TargetEdgeLength=0)
quad_remesh = QuadRemesh(MeshOrBrep=mesh_brep, QuadRemeshParameters=quad_remesh_parameters)
join_weld_meshes_2 = JoinWeldMeshes(Meshes=quad_remesh)
mesh_difference = MeshDifference(MeshesA=join_weld_meshes_2, MeshesB=mesh_2)

panel_30 = Panel("hollowed base mould")
panel_31 = Panel(" cutting shape")
mesh_split = MeshSplit(Mesh=mesh_difference, Splitters=flatten(weld_the_vertices_of_a_mesh))
mesh_face_count = MeshFaceCount(Mesh=mesh_split)
larger_than = LargerThan(FirstNumber=mesh_face_count, SecondNumber=15)  # -> LargerThan, OrEqualTo
cull_pattern = CullPattern(List=mesh_split, CullPattern=larger_than.LargerThan)
explode_tree_5 = ExplodeTree(Data=simplify(graft(cull_pattern)))  # -> Branch0, Branch1, Branch2, Branch3
panel_32 = Panel(" outer mesh")
panel_34 = Panel("inner mesh")
mesh_8 = Mesh(explode_tree_5.Branch0)
mesh_9 = Mesh(explode_tree_5.Branch2)
mesh_10 = Mesh(explode_tree_5.Branch3)
mesh_11 = Mesh(explode_tree_5.Branch1)

# ----
# create connector planes + join appropriate meshes
cluster_2 = Cluster_2(
    geometry=scale.Geometry,
    mesh=mesh_8,
    meshes=[mesh_8, mesh_10],
    list=divide_curve.Points,
    point_b=divide_curve.Points,
    point=divide_curve.Points,
    mesh_2=mesh_10)
cluster_3 = Cluster_2(
    geometry=scale.Geometry,
    mesh=mesh_11,
    meshes=[mesh_11, mesh_9],
    list=divide_curve.Points,
    point_b=divide_curve.Points,
    point=divide_curve.Points,
    mesh_2=mesh_9)
unweld_explode = UnweldExplode(M=cluster_3, N=True, T=1.570796327)  # -> out, A; inputs M: Mesh
# ---------- unweld_explode: VB ----------
    Component.Params.Input(0).Name = "Mesh"
    Component.Params.Input(0).Description = "Open or closed mesh"
    Component.Params.Input(1).Name = "Modify Normals"
    Component.Params.Input(1).Description = "An optional boolean that specifies whether vertex normals will be maintained if false or recalculated with the new face"
    Component.Params.Input(2).Name = "Tolerance"
    Component.Params.Input(2).Description = "The angle tolerance in radians"

    Component.Params.Output(1).Name = "Mesh"
    Component.Params.Output(1).Description = "If successful, a list of valid meshes"
    If m IsNot Nothing Then
      Dim msh() As mesh
      m.Unweld(T, N)
      msh = m.ExplodeAtUnweldedEdges()

      A = msh
    End If
# ---------- end unweld_explode ----------
unweld_explode_2 = UnweldExplode(M=cluster_2, N=True, T=1.570796327)  # -> out, A; inputs M: Mesh; same code as unweld_explode
join_weld_meshes_3 = JoinWeldMeshes(Meshes=unweld_explode.A)
join_weld_meshes_4 = JoinWeldMeshes(Meshes=unweld_explode_2.A)

mesh_report = MeshReport()
panel_36 = Panel(mesh_report)

# ----
# Prevents plane from being invalid
panel_37 = Panel("180")
dom_2 = ConstructDomain(DomainStart="-180", DomainEnd=panel_37)
remap = RemapNumbers(Value=number_slider_2, Source=dom_2, Target=dom)  # -> Mapped, Clipped
remap_2 = RemapNumbers(Value=number_slider_3, Source=dom_2, Target=dom)  # -> Mapped, Clipped
remap_3 = RemapNumbers(Value=number_slider, Source=dom_2, Target=dom)  # -> Mapped, Clipped
ma = MassAddition(Input=[remap_3.Mapped, remap.Mapped, remap_2.Mapped])  # -> Result, PartialResults
equals = Equality(FirstNumber=ma.Result, SecondNumber="0")  # -> Equality, Inequality
multiplication_4 = Multiplication(A="0.001", B=equals.Equality)
addition = Addition(A=multiplication_4, B=remap_3.Mapped)
addition_2 = Addition(A=multiplication_4, B=remap.Mapped)
addition_3 = Addition(A=multiplication_4, B=remap_2.Mapped)
vec = VectorXYZ(XComponent=addition, YComponent=addition_2, ZComponent=addition_3)  # -> unitize(Vector), Length
# Split mesh - colors
# Eval srf
number_slider_5 = Slider(100, range=0..100)
pl = PlaneNormal(Origin=Point(0, 0, 0), ZAxis=vec.Vector)

reverse = Reverse(Vector=vec.Vector)

line_sdl = LineSDL(Start=pl, Direction=reverse, Length=number_slider_5)

deconstruct_mesh = DeconstructMesh(Mesh=mesh)  # -> Vertices, flatten(Faces), Colours, Normals
face_normals = FaceNormals(Mesh=mesh)  # -> Centers, Normals
angle = Angle(VectorA=face_normals.Normals, VectorB=vec.Vector)  # -> Angle, Reflex

equals_2 = Equality(FirstNumber=angle.Angle, SecondNumber="0.5 * Pi")  # -> Equality, Inequality
cull = CullPattern(List=deconstruct_mesh.Faces, CullPattern=equals_2.Equality)
construct_mesh = ConstructMesh(Vertices=deconstruct_mesh.Vertices, Faces=cull)
mesh_colours = MeshColours(Mesh=construct_mesh, Colours=ColourSwatch(SwatchColor=RGB(44, 145, 55)))

smaller = SmallerThan(FirstNumber=angle.Angle, SecondNumber="0.5 * Pi")  # -> SmallerThan, OrEqualTo
cull_2 = CullPattern(List=deconstruct_mesh.Faces, CullPattern=smaller.SmallerThan)
construct_mesh_2 = ConstructMesh(Vertices=deconstruct_mesh.Vertices, Faces=cull_2)
mesh_colours_2 = MeshColours(Mesh=construct_mesh_2, Colours=ColourSwatch(SwatchColor=RGB(199, 190, 30)))

larger = LargerThan(FirstNumber=angle.Angle, SecondNumber="0.5 * Pi")  # -> LargerThan, OrEqualTo
cull_3 = CullPattern(List=deconstruct_mesh.Faces, CullPattern=larger.LargerThan)
construct_mesh_3 = ConstructMesh(Vertices=deconstruct_mesh.Vertices, Faces=cull_3)
mesh_colours_3 = MeshColours(Mesh=construct_mesh_3, Colours=ColourSwatch(SwatchColor=RGB(63, 124, 143)))

rebuild_mesh = RebuildMesh(
    Mesh=construct_mesh_3,
    RebuildNormals=False,
    CullUnused=True,
    UnifyNormals=False,
    FlipNormals=False,
    IdenticalCombine=False,
    WeldVertices=0)
deconstruct_mesh_2 = DeconstructMesh(Mesh=rebuild_mesh)  # -> Vertices, Faces, Colours, Normals
occlusion = Occlusion(Samples=deconstruct_mesh_2.Vertices, Obstructions=mesh_2, Rays=vec.Vector)  # -> Hits, Occlusion
dispatch = Dispatch(List=deconstruct_mesh_2.Vertices, DispatchPattern=occlusion.Hits)  # -> simplify(ListA), simplify(ListB)

mesh_closest_point = MeshClosestPoint(Point=dispatch.ListA, Mesh=construct_mesh)  # -> Point, Index, Parameter
distance = Distance(PointA=mesh_closest_point.Point, PointB=dispatch.ListA)
# cull fake undercut regions
smaller_than = SmallerThan(FirstNumber=distance, SecondNumber="0.01")  # -> SmallerThan, OrEqualTo
dispatch_2 = Dispatch(List=dispatch.ListA, DispatchPattern=smaller_than.SmallerThan)  # -> ListA, ListB
point = Point(flatten(dispatch_2.ListB))

lng = ListLength(List=point)
null = NullItem(Item=lng)  # -> NullFlags, InvalidFlags, Description
pt = Point(dispatch.ListA)
filter = StreamFilter(Gate=null.NullFlags, Stream0=point, Stream1=pt)
pt_2 = Point(filter)

lng_2 = ListLength(List=pt_2)

construct_mesh_4 = ConstructMesh(Vertices=deconstruct_mesh_2.Vertices, Faces=graft(deconstruct_mesh_2.Faces))  # -> simplify(Mesh)
mesh_closest_point_2 = MeshClosestPoint(Point=pt_2, Mesh=graft(construct_mesh_4))  # -> Point, Index, Parameter
distance_2 = Distance(PointA=pt_2, PointB=mesh_closest_point_2.Point)
# occluded mesh from occluded points
sort_list_5 = SortList(Keys=distance_2)  # -> Keys, ValuesValuesA
list_item = ListItem(List=sort_list_5.Keys, Index=0, Wrap=True)
smaller_than_2 = SmallerThan(FirstNumber=list_item, SecondNumber="0.01")  # -> simplify(SmallerThan), OrEqualTo
cull_pattern_2 = CullPattern(List=construct_mesh_4, CullPattern=smaller_than_2.SmallerThan)  # -> flatten(List)

disjoint_mesh = DisjointMesh(Mesh=construct_mesh)  # -> flatten(Meshes)
mesh_12 = Mesh(construct_mesh_3)
mesh_mesh_2 = MeshMesh(MeshA=graft(disjoint_mesh), MeshB=mesh_12)  # -> simplify(Intersections)
# add regions with zero draft angle to appropriate mould part
list_length = ListLength(List=mesh_mesh_2)
larger_than_2 = LargerThan(FirstNumber=list_length, SecondNumber=Slider(0, range=0..100))  # -> flatten(LargerThan), OrEqualTo
dispatch_3 = Dispatch(List=disjoint_mesh, DispatchPattern=larger_than_2.LargerThan)  # -> flatten(ListA), ListB
join_weld_meshes_5 = JoinWeldMeshes(Meshes=flatten([dispatch_3.ListA, mesh_12]))

# ----
# yellow with the rest of the green
# yellow with occluded areas
mesh_join = MeshJoin(Meshes=cull_pattern_2)
weld_mesh = WeldMesh(Mesh=mesh_join, Angle=3.141592654)
mesh_13 = Mesh(mesh_colours_2)
mesh_14 = Mesh(weld_mesh)
null_2 = NullItem(Item=mesh_14)  # -> NullFlags, InvalidFlags, Description
mesh_15 = Mesh()
filter_2 = StreamFilter(Gate=null_2.NullFlags, Stream0=mesh_14, Stream1=mesh_15)
join_weld_meshes_6 = JoinWeldMeshes(Meshes=flatten([filter_2, mesh_13]))
join_weld_meshes_7 = JoinWeldMeshes(Meshes=flatten([dispatch_3.ListB, join_weld_meshes_6]))

face_normals_2 = FaceNormals(Mesh=weld_mesh)  # -> Centers, Normals
face_normals_3 = FaceNormals(Mesh=join_weld_meshes_5)  # -> Centers, Normals
closest_points = ClosestPoints(Point=face_normals_2.Centers, Cloud=face_normals_3.Centers, Count="1")  # -> ClosestPoint, flatten(CPIndex), Distance
deconstruct_mesh_3 = DeconstructMesh(Mesh=join_weld_meshes_5)  # -> Vertices, Faces, Colours, Normals
cull_index = CullIndex(List=deconstruct_mesh_3.Faces, Indices=closest_points.CPIndex, Wrap=True)
panel_38 = Panel("blue with green")
construct_mesh_5 = ConstructMesh(Vertices=deconstruct_mesh_3.Vertices, Faces=cull_index)
mesh_16 = Mesh(construct_mesh_5)
mesh_colours_4 = MeshColours(Mesh=mesh_16, Colours=ColourSwatch(SwatchColor=RGB(150, 7, 163)))
is_mesh_disjoint = IsMeshDisjoint(Mesh=mesh_16)  # -> Disjoint, Amount

is_mesh_disjoint_2 = IsMeshDisjoint(Mesh=join_weld_meshes_7)  # -> Disjoint, Amount
data_2 = Data(deconstruct_mesh.Vertices)
data_3 = Data(lng_2)
null_3 = NullItem(Item=data_3)  # -> NullFlags, InvalidFlags, Description
equals_3 = Equality(FirstNumber=data_3, SecondNumber=0)  # -> Equality, Inequality
or = GateOr(A=null_3.NullFlags, B=equals_3.Equality)

list_length_2 = ListLength(List=data_2)
division_6 = Division(A="40", B="1200")
division_7 = Division(A="40", B="1200")
multiplication_5 = Multiplication(A=list_length_2, B=division_6)
multiplication_6 = Multiplication(A=list_length_2, B=division_7)
division_8 = Division(A=data_3, B=list_length_2)
stream_filter_2 = StreamFilter(Gate=boolean_toggle, Stream0=multiplication_5, Stream1=multiplication_6)
multiplication_7 = Multiplication(A=division_8, B=stream_filter_2)

# ----
# amount of meshes leftover mesh
subtraction_6 = Subtraction(A=is_mesh_disjoint_2.Amount, B=1)
multiplication_8 = Multiplication(A=subtraction_6, B=Slider(2, range=1..25))

# ----
# amount of meshes used mesh
subtraction_7 = Subtraction(A=is_mesh_disjoint.Amount, B=0.99)
multiplication_9 = Multiplication(A=subtraction_7, B=Slider(2, range=1..25))

# ----
# amount of meshes used mesh
subtraction_8 = Subtraction(A=is_mesh_disjoint.Amount, B=1)
multiplication_10 = Multiplication(A=subtraction_8, B=Slider(50, range=5..55))

# ----
# amount of meshes leftover mesh
subtraction_9 = Subtraction(A=is_mesh_disjoint_2.Amount, B=1)
multiplication_11 = Multiplication(A=subtraction_9, B=Slider(15, range=1..25))

# ----
# number of meshes leftover mesh
subtraction_10 = Subtraction(A=is_mesh_disjoint_2.Amount, B=1)
multiplication_12 = Multiplication(A=subtraction_10, B=Slider(15, range=0..100))

# ----
# number of meshes used mesh
subtraction_11 = Subtraction(A=is_mesh_disjoint.Amount, B=1)
multiplication_13 = Multiplication(A=subtraction_11, B=Slider(15, range=1..25))

multiplication_14 = Multiplication(A=data_3, B=Slider(10, range=0..10))

# ----
# multi part asymmetric mesh
addition_4 = Addition(A=multiplication_11, B=multiplication_10, C=multiplication_3, D=stream_filter_2)
# quasi symmetric multi part mould
addition_5 = Addition(A=multiplication_12, B=multiplication_13, C=multiplication, D=multiplication_7)
addition_6 = Addition(A=multiplication_2, B=multiplication_8, C=multiplication_9, D=multiplication_14)
stream_filter_3 = StreamFilter(Gate=subtraction_4, Stream0=addition_6, Stream1=addition_4, Stream2=addition_5)
number = Number(stream_filter_3)
data_4 = Data(number)

# ==== cluster Cluster
curve = ClusterInput()
discontinuity = Discontinuity(Curve=curve, Level=1)  # -> Points, Parameters
curve_2 = ClusterInput()
curveshatter = CurveShatter(Curve=curve_2, Points=discontinuity.Points, Tolerance=0.01)
end_points = EndPoints(Curve=curveshatter)  # -> Start, End
cull_duplicates = CullDuplicates(Points=[end_points.Start, end_points.End], Tolerance=0.1, CullMode=3)  # -> Points, Indices, Valence
curve_3 = ClusterInput()
curve_closest_point = CurveClosestPoint(Point=flatten(cull_duplicates.Points), Curve=graft(curve_3))  # -> Point, Parameter, Distance
smaller_than = SmallerThan(FirstNumber=curve_closest_point.Distance, SecondNumber=Slider(0.1, range=0..0.1))  # -> SmallerThan, OrEqualTo
polyline = PolyLine(Vertices=flatten(cull_duplicates.Points), Closed=False)
cull_pattern = CullPattern(List=curve_closest_point.Point, CullPattern=smaller_than.SmallerThan)
curveshatter_2 = CurveShatter(Curve=polyline, Points=cull_duplicates.Points, Tolerance=0.01)
smooth_network_of_lines_by_daniel_piker = SmoothNetworkOfLinesByDanielPiker(Lines=curveshatter_2, Points=flatten(cull_pattern), Level=Slider(11, range=1..20), Tolerance=0.01)
smoothedpolylines = ClusterOutput(smooth_network_of_lines_by_daniel_piker)

# ==== cluster Cluster_2
mesh = ClusterInput()
point = ClusterInput()
mesh_2 = ClusterInput()
mesh_edges = MeshEdges(Mesh=mesh)  # -> NakedEdges, InteriorEdges, NonManifoldEdges
mesh_closest_point = MeshClosestPoint(Point=flatten(point), Mesh=mesh_2)  # -> Point, Index, Parameter
point_b = ClusterInput()
join_curves = JoinCurves(Curves=mesh_edges.NakedEdges, Preserve=False)
distance = Distance(PointA=mesh_closest_point.Point, PointB=flatten(point_b))
smaller_than = SmallerThan(FirstNumber=distance, SecondNumber=Slider(0.01, range=0..0.1))  # -> SmallerThan, OrEqualTo
list = ClusterInput()
construct_point = ConstructPoint(XCoordinate=0, YCoordinate=0, ZCoordinate=0)
cull_pattern = CullPattern(List=flatten(list), CullPattern=smaller_than.OrEqualTo)
vector_2pt = Vector2Pt(PointA=construct_point, PointB=cull_pattern, Unitize=False)  # -> Vector, Length
geometry = ClusterInput()
project_point = ProjectPoint(Point=flatten(cull_pattern), Direction=flatten(vector_2pt.Vector), Geometry=geometry)  # -> Point, Index
line = Line(StartPoint=cull_pattern, EndPoint=project_point.Point)
sort_curves_along_crv = SortCurvesAlongCrv(Curves=line, GuideCrv=join_curves, CrvParam=0.5)  # -> SortedCurves, CurveIndex
loftmesh = LoftMesh(Polylines=sort_curves_along_crv.SortedCurves, CloseLoft=False)
weld_the_vertices_of_a_mesh = WeldTheVerticesOfAMesh(Mesh=loftmesh, Tolerance=Slider(0.5, range=0..2))
meshes = ClusterInput()
mesh_join = MeshJoin(Meshes=flatten([weld_the_vertices_of_a_mesh, meshes]))
mesh_3 = ClusterOutput(mesh_join)
